# Dynamo graph Auto Header V 1.29.dyn (Dynamo 2.16.2.5624)
# author: Yousef Altear
# Auo Paradigm Header
# packages: Clockwork for Dynamo 2.x 2.6.0, Rhythm 2023.9.1, Genius Loci 2023.7.13, archi-lab.net 2024.217.1024

# group: Auto Paradigm Header
# note: Ⓒ Copyright of Script to Paragons Egypt Team

# group: Multiple Window
all_elements_in_active_view = ElementsInView()
string_from_object = FromObject(object=all_elements_in_active_view)
code_block = CodeBlock { "AssemblyInstance"; }
eq = string_from_object == code_block
filterByBoolMask = List.FilterByBoolMask(list=all_elements_in_active_view, mask=eq)
members = Custom[Assembly.Members](assembly=filterByBoolMask.in)  # package Clockwork for Dynamo 2.x; Retrieves the members of an assembly
string_from_object_2 = FromObject(object=members)
code_block_2 = CodeBlock { "Main"; }
code_block_3 = CodeBlock { "Secondary"; }
list_create = List.Create(item0=code_block_2, item1=code_block_3)
eq_2 = string_from_object_2 == list_create  # lacing=CrossProduct
anyTrue = Custom[Booleans.AnyTrue](seq=eq_2)  # package Clockwork for Dynamo 2.x; Returns true if any item in a list of booleans is true. ATTENTION: This node will be deprecated in 2024. As of Revit 2022, please switch to the OOTB node AnyTrue.
anyTrue_2 = List.AnyTrue(list=anyTrue@L2)
filterByBoolMask_2 = List.FilterByBoolMask(list=filterByBoolMask.in, mask=anyTrue_2)
members_2 = Custom[Assembly.Members](assembly=filterByBoolMask_2.in)
members_3 = Custom[Assembly.Members](assembly=filterByBoolMask_2.out)

# group: Window Row
code_block_4 = CodeBlock { 1; }
flatten = List.Flatten(list=members_3@L2, amount=code_block_4)
getLocation = Element.GetLocation(element=members_3)
Z = Point.Z(point=getLocation@L2)
flatten_2 = List.Flatten(list=Z@L2, amount=code_block_4)
maximumItem = List.MaximumItem(list=Z@L2)
code_block_5 = CodeBlock { 1; }
chop = List.Chop(list=maximumItem, lengths=code_block_5)
eq_3 = flatten_2@L2 == chop@L1
filterByBoolMask_3 = List.FilterByBoolMask(list=flatten, mask=eq_3)

# group: Get Transom Window
count = List.Count(list=filterByBoolMask_3.in@L2)
code_block_6 = CodeBlock { 1; }
gt = count > code_block_6
filterByBoolMask_4 = List.FilterByBoolMask(list=filterByBoolMask_2.out, mask=gt)

# group: Get Transom Door & Window
members_4 = Custom[Assembly.Members](assembly=filterByBoolMask_4.in)
getCategory = Element.GetCategory(element=members_4)
string_from_object_3 = FromObject(object=getCategory)
code_block_7 = CodeBlock { "Doors"; }
eq_4 = string_from_object_3@L2 == code_block_7
anyTrue_3 = List.AnyTrue(list=eq_4@L2)
filterByBoolMask_5 = List.FilterByBoolMask(list=filterByBoolMask_4.in, mask=anyTrue_3)

# group: z sortation
members_5 = Custom[Assembly.Members](assembly=filterByBoolMask_5.out)
getLocation_2 = Element.GetLocation(element=members_5)
Z_2 = Point.Z(point=getLocation_2)
maximumItem_2 = List.MaximumItem(list=Z_2)
eq_5 = Z_2 == maximumItem_2
filterByBoolMask_6 = List.FilterByBoolMask(list=members_5, mask=eq_5)

# group: X ,Y Sortation
list_create_2 = List.Create()  # unwired: item0, item1
getLocation_3 = Element.GetLocation(element=filterByBoolMask_6.in)
X = Point.X(point=getLocation_3)
firstItem = List.FirstItem(list=X@L2)
code_block_8 = CodeBlock { 1; }
chop_2 = List.Chop(list=firstItem, lengths=code_block_8)
eq_6 = X@L2 == chop_2@L1
anyFalse = List.AnyFalse(list=eq_6@L2)
chop_3 = List.Chop(list=anyFalse, lengths=code_block_8)
Y = Point.Y(point=getLocation_3)
firstItem_2 = List.FirstItem(list=Y@L2)
chop_4 = List.Chop(list=firstItem_2, lengths=code_block_8)
eq_7 = Y@L2 == chop_4@L1
anyFalse_2 = List.AnyFalse(list=eq_7@L2)
chop_5 = List.Chop(list=anyFalse_2, lengths=code_block_8)
combine = List.Combine(combineFunction=list_create_2, list0=chop_3, list1=chop_5)
firstItem_3 = List.FirstItem(list=combine@L3)
if_ = RefactoredIf(test=firstItem_3@L1, true=X@L2, false=Y@L2)
sortIndexByValue = List.SortIndexByValue(list=if_)

# group: Compare
sortByKey = List.SortByKey(list=filterByBoolMask_6.in@L2, keys=sortIndexByValue@L2)
code_block_9 = CodeBlock { 2; }
takeItems = List.TakeItems(list=sortByKey.sortedList@L2, amount=code_block_9)
getLocation_4 = Element.GetLocation(element=takeItems@L2)
byBestFitThroughPoints = Line.ByBestFitThroughPoints(bestFitPoints=getLocation_4@L2)
code_block_10 = CodeBlock { "Width"; }
ʳʰʸᵗʰᵐ_elements = Rhythm.Revit.Elements.Elements.GetParameterValueByNameTypeOrInstance(element=takeItems, parameterName=code_block_10)
code_block_11 = CodeBlock { 2; }
list_clean = Custom[List Clean](list=byBestFitThroughPoints)  # package Genius Loci; Removes all Null, Empty and Blank from a list or nested list of lists.

# group: filtration
length = Curve.Length(curve=byBestFitThroughPoints)
div = ʳʰʸᵗʰᵐ_elements / code_block_11
sum = Math.Sum(values=div)
le = length <= sum

# group: Get
flatten_3 = List.Flatten(list=le)
filterByBoolMask_7 = List.FilterByBoolMask(list=filterByBoolMask_5.out, mask=flatten_3)
members_6 = Custom[Assembly.Members](assembly=filterByBoolMask_7.in)
members_7 = Custom[Assembly.Members](assembly=filterByBoolMask_7.out)

# group: Get Transom Door & Window
members_8 = Custom[Assembly.Members](assembly=filterByBoolMask_4.out)
getCategory_2 = Element.GetCategory(element=members_8)
string_from_object_4 = FromObject(object=getCategory_2)
code_block_12 = CodeBlock { "Doors"; }
eq_8 = string_from_object_4@L2 == code_block_12
anyTrue_4 = List.AnyTrue(list=eq_8@L2)
filterByBoolMask_8 = List.FilterByBoolMask(list=filterByBoolMask_4.out, mask=anyTrue_4)

# group: Door Row
members_9 = Custom[Assembly.Members](assembly=filterByBoolMask_8.out)
code_block_13 = CodeBlock { 1; }
flatten_4 = List.Flatten(list=members_9@L2, amount=code_block_13)
getLocation_5 = Element.GetLocation(element=members_9)
Z_3 = Point.Z(point=getLocation_5@L2)
flatten_5 = List.Flatten(list=Z_3@L2, amount=code_block_13)
maximumItem_3 = List.MaximumItem(list=Z_3@L2)
code_block_14 = CodeBlock { 1; }
chop_6 = List.Chop(list=maximumItem_3, lengths=code_block_14)
eq_9 = flatten_5@L2 == chop_6@L1
filterByBoolMask_9 = List.FilterByBoolMask(list=flatten_4, mask=eq_9)

# group: Get second window
getLocation_6 = Element.GetLocation(element=filterByBoolMask_9.out)
Z_4 = Point.Z(point=getLocation_6)
maximumItem_4 = List.MaximumItem(list=Z_4)
eq_10 = Z_4 == maximumItem_4
filterByBoolMask_10 = List.FilterByBoolMask(list=filterByBoolMask_9.out, mask=eq_10)
firstItem_4 = List.FirstItem(list=filterByBoolMask_10.in@L2)
code_block_15 = CodeBlock { 1; }
chop_7 = List.Chop(list=firstItem_4, lengths=code_block_15)
getLocation_7 = Element.GetLocation(element=chop_7)
Z_5 = Point.Z(point=getLocation_7)

# group: First window
firstItem_5 = List.FirstItem(list=filterByBoolMask_9.in@L2)
code_block_16 = CodeBlock { 1; }
chop_8 = List.Chop(list=firstItem_5, lengths=code_block_16)
getLocation_8 = Element.GetLocation(element=chop_8)
X_2 = Point.X(point=getLocation_8)
Y_2 = Point.Y(point=getLocation_8)
byCoordinates = Point.ByCoordinates(x=X_2, y=Y_2, z=Z_5)
byStartPointEndPoint = Line.ByStartPointEndPoint(startPoint=getLocation_8, endPoint=byCoordinates)
length_2 = Curve.Length(curve=byStartPointEndPoint)

# group: Height
code_block_17 = CodeBlock { "Height"; }
ʳʰʸᵗʰᵐ_elements_2 = Rhythm.Revit.Elements.Elements.GetParameterValueByNameTypeOrInstance(element=chop_7, parameterName=code_block_17)
eq_11 = length_2 == ʳʰʸᵗʰᵐ_elements_2
flatten_6 = List.Flatten(list=eq_11)

# group (continued): Get second window
filterByBoolMask_11 = List.FilterByBoolMask(list=filterByBoolMask_8.out, mask=flatten_6)
members_10 = Custom[Assembly.Members](assembly=filterByBoolMask_11.in)

# group: Single Windows
categories = Categories("OST_Windows")
all_family_types_of_category = Custom[All Family Types Of Category](category=categories)  # package Clockwork for Dynamo 2.x; Gets all family types/symbols of a given category in the model.
byFamilyType = FamilyInstance.ByFamilyType(familyType=all_family_types_of_category)
flatten_7 = List.Flatten(list=byFamilyType)
id = Element.Id(element=members_2)
id_2 = Element.Id(element=members_6)
id_3 = Element.Id(element=members_10)
list_create_3 = List.Create(item0=id, item1=id_2, item2=id_3)
flatten_8 = List.Flatten(list=list_create_3)
count_2 = List.Count(list=flatten_8)

# group: Interior Window
element_host = Custom[Element Host](element=flatten_7)  # package Genius Loci; Gets the host of the element. Unlike the OOTB node FamilyInstance.GetHost, it also works for elements hosted by a linked document, wall sweeps, foundations, railings and builing pads. Based on a Clockwork's node
code_block_18 = CodeBlock { "Function"; }
ʳʰʸᵗʰᵐ_elements_3 = Rhythm.Revit.Elements.Elements.GetParameterValueByNameTypeOrInstance(element=element_host, parameterName=code_block_18)
code_block_19 = CodeBlock { 0; "INTERIOR WALL"; }
eq_12 = ʳʰʸᵗʰᵐ_elements_3 == code_block_19.out0
code_block_20 = CodeBlock { "Wall Type"; }
ʳʰʸᵗʰᵐ_elements_4 = Rhythm.Revit.Elements.Elements.GetParameterValueByNameTypeOrInstance(element=element_host, parameterName=code_block_20)
eq_13 = ʳʰʸᵗʰᵐ_elements_4 == code_block_19.out1
and_ = And(bool0=eq_12, bool1=eq_13)
filterByBoolMask_12 = List.FilterByBoolMask(list=flatten_7, mask=and_)

# group (continued): Single Windows
id_4 = Element.Id(element=filterByBoolMask_12.out)
eq_14 = id_4 == flatten_8  # lacing=CrossProduct
anyTrue_5 = List.AnyTrue(list=eq_14@L2)
filterByBoolMask_13 = List.FilterByBoolMask(list=filterByBoolMask_12.out, mask=anyTrue_5)
count_3 = List.Count(list=filterByBoolMask_13.in)

# group: Headeer Count
code_block_21 = CodeBlock { "Header Count"; }
code_block_22 = CodeBlock { 2; }
ʳʰʸᵗʰᵐ_elements_5 = Rhythm.Revit.Elements.Elements.SetParameterByNameTypeOrInstance(element=filterByBoolMask_13.out, parameterName=code_block_21, value=code_block_22)

# group: Match Type
code_block_23 = CodeBlock { "Width"; }
ʳʰʸᵗʰᵐ_elements_6 = Rhythm.Revit.Elements.Elements.GetParameterValueByNameTypeOrInstance(element=filterByBoolMask_13.out, parameterName=code_block_23)

# group: Dimentional 2X10 Filter
code_block_24 = CodeBlock(x=ʳʰʸᵗʰᵐ_elements_6) { x<=5.5; }
filterByBoolMask_14 = List.FilterByBoolMask(list=filterByBoolMask_13.out, mask=code_block_24)
filterByBoolMask_15 = List.FilterByBoolMask(list=ʳʰʸᵗʰᵐ_elements_6, mask=code_block_24)

# group: Heders Types
code_block_25 = CodeBlock { 6005790; 6005738; 6006151; 6005799; 6006154; 6006155; }
list_create_4 = List.Create(item0=code_block_25.out0, item1=code_block_25.out1, item2=code_block_25.out2, item3=code_block_25.out3, item4=code_block_25.out4, item5=code_block_25.out5)
element_by_id = ElementById(Id=list_create_4)
code_block_26 = CodeBlock { 0; 1; 2; 3; 4; 5; }
getItemAtIndex = List.GetItemAtIndex(list=element_by_id, index=code_block_26.out1)
getItemAtIndex_2 = List.GetItemAtIndex(list=element_by_id, index=code_block_26.out2)
getItemAtIndex_3 = List.GetItemAtIndex(list=element_by_id, index=code_block_26.out3)
getItemAtIndex_4 = List.GetItemAtIndex(list=element_by_id, index=code_block_26.out4)
getItemAtIndex_5 = List.GetItemAtIndex(list=element_by_id, index=code_block_26.out5)
getItemAtIndex_6 = List.GetItemAtIndex(list=element_by_id, index=code_block_26.out0)
name = Element.Name(element=element_by_id)

# group: Dimentional 2X10
code_block_27 = CodeBlock { "DIMENSIONAL : 2x10"; }
code_block_28 = CodeBlock { "Header Type"; }
ʳʰʸᵗʰᵐ_elements_7 = Rhythm.Revit.Elements.Elements.SetParameterByNameTypeOrInstance(element=filterByBoolMask_14.in, parameterName=code_block_28, value=getItemAtIndex)

# group: LVL: 9-1/4"
code_block_29 = CodeBlock(x=filterByBoolMask_15.out) { x<=9.5; }
filterByBoolMask_16 = List.FilterByBoolMask(list=filterByBoolMask_14.out, mask=code_block_29)
filterByBoolMask_17 = List.FilterByBoolMask(list=filterByBoolMask_15.out, mask=code_block_29)

# group: LVL: 9-1/4"
code_block_30 = CodeBlock { "LVL: 9-1/4"; }
code_block_31 = CodeBlock { "Header Type"; }
ʳʰʸᵗʰᵐ_elements_8 = Rhythm.Revit.Elements.Elements.SetParameterByNameTypeOrInstance(element=filterByBoolMask_16.in, parameterName=code_block_31, value=getItemAtIndex_2)

# group: LVL: 11-7/8" Filter
code_block_32 = CodeBlock(x=filterByBoolMask_17.out) { x<=15.5; }
filterByBoolMask_18 = List.FilterByBoolMask(list=filterByBoolMask_16.out, mask=code_block_32)
filterByBoolMask_19 = List.FilterByBoolMask(list=filterByBoolMask_17.out, mask=code_block_32)

code_block_33 = CodeBlock { "Header Type"; }

# group: LVL: 11-7/8"
code_block_34 = CodeBlock { "LVL: 11-7/8"; }
ʳʰʸᵗʰᵐ_elements_9 = Rhythm.Revit.Elements.Elements.SetParameterByNameTypeOrInstance(element=filterByBoolMask_18.in, parameterName=code_block_33, value=getItemAtIndex_3)

# group: LVL: 14" Filter
code_block_35 = CodeBlock(x=filterByBoolMask_19.out) { x<=17.5; }
filterByBoolMask_20 = List.FilterByBoolMask(list=filterByBoolMask_18.out, mask=code_block_35)
filterByBoolMask_21 = List.FilterByBoolMask(list=filterByBoolMask_19.out, mask=code_block_35)

# group: LVL: 14"
code_block_36 = CodeBlock { "Header Type"; }
ʳʰʸᵗʰᵐ_elements_10 = Rhythm.Revit.Elements.Elements.SetParameterByNameTypeOrInstance(element=filterByBoolMask_20.in, parameterName=code_block_36, value=getItemAtIndex_4)
code_block_37 = CodeBlock { "LVL: 14"; }

# group: LVL:16" Filter
code_block_38 = CodeBlock(x=filterByBoolMask_21.out) { x>17.6; }
filterByBoolMask_22 = List.FilterByBoolMask(list=filterByBoolMask_20.out, mask=code_block_38)
filterByBoolMask_23 = List.FilterByBoolMask(list=filterByBoolMask_19.out, mask=code_block_38)

code_block_39 = CodeBlock { "Header Type"; }

# group: LVL:16"
code_block_40 = CodeBlock { "LVL:16"; }
ʳʰʸᵗʰᵐ_elements_11 = Rhythm.Revit.Elements.Elements.SetParameterByNameTypeOrInstance(element=filterByBoolMask_22.in, parameterName=code_block_39, value=getItemAtIndex_5)

# group: Window Row
members_11 = Custom[Assembly.Members](assembly=filterByBoolMask_8.in)
code_block_41 = CodeBlock { 1; }
flatten_9 = List.Flatten(list=members_11@L2, amount=code_block_41)
getLocation_9 = Element.GetLocation(element=members_11)
Z_6 = Point.Z(point=getLocation_9@L2)
flatten_10 = List.Flatten(list=Z_6@L2, amount=code_block_41)
maximumItem_5 = List.MaximumItem(list=Z_6@L2)
code_block_42 = CodeBlock { 1; }
chop_9 = List.Chop(list=maximumItem_5, lengths=code_block_42)
eq_15 = flatten_10@L2 == chop_9@L1
filterByBoolMask_24 = List.FilterByBoolMask(list=flatten_9, mask=eq_15)

# group: Get second Door
getLocation_10 = Element.GetLocation(element=filterByBoolMask_24.out)
Z_7 = Point.Z(point=getLocation_10)
maximumItem_6 = List.MaximumItem(list=Z_7)
eq_16 = Z_7 == maximumItem_6
filterByBoolMask_25 = List.FilterByBoolMask(list=filterByBoolMask_24.out, mask=eq_16)
firstItem_6 = List.FirstItem(list=filterByBoolMask_25.in@L2)
code_block_43 = CodeBlock { 1; }
chop_10 = List.Chop(list=firstItem_6, lengths=code_block_43)
getLocation_11 = Element.GetLocation(element=chop_10)
Z_8 = Point.Z(point=getLocation_11)

# group: First Door
firstItem_7 = List.FirstItem(list=filterByBoolMask_24.in@L2)
code_block_44 = CodeBlock { 1; }
chop_11 = List.Chop(list=firstItem_7, lengths=code_block_44)
getLocation_12 = Element.GetLocation(element=chop_11)
X_3 = Point.X(point=getLocation_12)
Y_3 = Point.Y(point=getLocation_12)
byCoordinates_2 = Point.ByCoordinates(x=X_3, y=Y_3, z=Z_8)
byStartPointEndPoint_2 = Line.ByStartPointEndPoint(startPoint=getLocation_12, endPoint=byCoordinates_2)
length_3 = Curve.Length(curve=byStartPointEndPoint_2)

# group: Rough Height
code_block_45 = CodeBlock { "Rough Height"; }
ʳʰʸᵗʰᵐ_elements_12 = Rhythm.Revit.Elements.Elements.GetParameterValueByNameTypeOrInstance(element=chop_10, parameterName=code_block_45)
eq_17 = length_3 == ʳʰʸᵗʰᵐ_elements_12
flatten_11 = List.Flatten(list=eq_17)

# group (continued): Get second Door
filterByBoolMask_26 = List.FilterByBoolMask(list=filterByBoolMask_8.in, mask=flatten_11)
members_12 = Custom[Assembly.Members](assembly=filterByBoolMask_26.in)

# group: X ,Y Sortation
members_13 = Custom[Assembly.Members](assembly=filterByBoolMask_5.in)
list_create_5 = List.Create()  # unwired: item0, item1
getLocation_13 = Element.GetLocation(element=members_13)
X_4 = Point.X(point=getLocation_13)
firstItem_8 = List.FirstItem(list=X_4@L2)
code_block_46 = CodeBlock { 1; }
chop_12 = List.Chop(list=firstItem_8, lengths=code_block_46)
eq_18 = X_4@L2 == chop_12@L1
anyFalse_3 = List.AnyFalse(list=eq_18@L2)
chop_13 = List.Chop(list=anyFalse_3, lengths=code_block_46)
Y_4 = Point.Y(point=getLocation_13)
firstItem_9 = List.FirstItem(list=Y_4@L2)
chop_14 = List.Chop(list=firstItem_9, lengths=code_block_46)
eq_19 = Y_4@L2 == chop_14@L1
anyFalse_4 = List.AnyFalse(list=eq_19@L2)
chop_15 = List.Chop(list=anyFalse_4, lengths=code_block_46)
combine_2 = List.Combine(combineFunction=list_create_5, list0=chop_13, list1=chop_15)
firstItem_10 = List.FirstItem(list=combine_2@L3)
if_2 = RefactoredIf(test=firstItem_10@L1, true=X_4@L2, false=Y_4@L2)
sortIndexByValue_2 = List.SortIndexByValue(list=if_2)

# group: Compare
sortByKey_2 = List.SortByKey(list=members_13@L2, keys=sortIndexByValue_2@L2)
code_block_47 = CodeBlock { 2; }
takeItems_2 = List.TakeItems(list=sortByKey_2.sortedList@L2, amount=code_block_47)
getLocation_14 = Element.GetLocation(element=takeItems_2@L2)
byBestFitThroughPoints_2 = Line.ByBestFitThroughPoints(bestFitPoints=getLocation_14@L2)
code_block_48 = CodeBlock { "Rough Width"; }
ʳʰʸᵗʰᵐ_elements_13 = Rhythm.Revit.Elements.Elements.GetParameterValueByNameTypeOrInstance(element=takeItems_2, parameterName=code_block_48)
code_block_49 = CodeBlock { 2; }
list_clean_2 = Custom[List Clean](list=byBestFitThroughPoints_2)

# group: filtration
length_4 = Curve.Length(curve=byBestFitThroughPoints_2)
code_block_50 = CodeBlock { 3; }
round = Math.Round(number=length_4, digits=code_block_50)
div_2 = ʳʰʸᵗʰᵐ_elements_13 / code_block_49
sum_2 = Math.Sum(values=div_2)
round_2 = Math.Round(number=sum_2, digits=code_block_50)
le_2 = round <= round_2

# group: Get
flatten_12 = List.Flatten(list=le_2)
filterByBoolMask_27 = List.FilterByBoolMask(list=filterByBoolMask_5.in, mask=flatten_12)
members_14 = Custom[Assembly.Members](assembly=filterByBoolMask_27.in)
members_15 = Custom[Assembly.Members](assembly=filterByBoolMask_27.out)

# group: Remove Mulions
string_from_object_5 = FromObject(object=members_2)
code_block_51 = CodeBlock { "Main"; }
eq_20 = string_from_object_5 == code_block_51
filterByBoolMask_28 = List.FilterByBoolMask(list=members_2, mask=eq_20)
string_from_object_6 = FromObject(object=filterByBoolMask_28.out)
code_block_52 = CodeBlock { "Secondary"; }
eq_21 = string_from_object_6 == code_block_52
filterByBoolMask_29 = List.FilterByBoolMask(list=filterByBoolMask_28.out, mask=eq_21)
list_create_6 = List.Create(item0=filterByBoolMask_29.out, item1=members_6, item2=members_10, item3=members_12, item4=members_14)

# group: Window Row
code_block_53 = CodeBlock { 1; }
flatten_13 = List.Flatten(list=list_create_6, amount=code_block_53)
getLocation_15 = Element.GetLocation(element=list_create_6)
Z_9 = Point.Z(point=getLocation_15)
flatten_14 = List.Flatten(list=Z_9, amount=code_block_53)
maximumItem_7 = List.MaximumItem(list=Z_9@L2)
code_block_54 = CodeBlock { 1; }
chop_16 = List.Chop(list=maximumItem_7, lengths=code_block_54)
eq_22 = flatten_14@L2 == chop_16@L1
filterByBoolMask_30 = List.FilterByBoolMask(list=flatten_13, mask=eq_22)

# group: Get middle window
code_block_55 = CodeBlock { 2; }
flatten_15 = List.Flatten(list=filterByBoolMask_30.in@L2, amount=code_block_55)
code_block_56 = CodeBlock { 1; }
code_block_57 = CodeBlock { 2; }
code_block_58 = CodeBlock { 1; }

# group: X ,Y Sortation
list_create_7 = List.Create()  # unwired: item0, item1
getLocation_16 = Element.GetLocation(element=flatten_15)
X_5 = Point.X(point=getLocation_16)
firstItem_11 = List.FirstItem(list=X_5@L2)
code_block_59 = CodeBlock { 1; }
chop_17 = List.Chop(list=firstItem_11, lengths=code_block_59)
eq_23 = X_5@L2 == chop_17@L1
anyFalse_5 = List.AnyFalse(list=eq_23@L2)
chop_18 = List.Chop(list=anyFalse_5, lengths=code_block_59)
Y_5 = Point.Y(point=getLocation_16)
firstItem_12 = List.FirstItem(list=Y_5@L2)
chop_19 = List.Chop(list=firstItem_12, lengths=code_block_59)
eq_24 = Y_5@L2 == chop_19@L1
anyFalse_6 = List.AnyFalse(list=eq_24@L2)
chop_20 = List.Chop(list=anyFalse_6, lengths=code_block_59)
combine_3 = List.Combine(combineFunction=list_create_7, list0=chop_18, list1=chop_20)
firstItem_13 = List.FirstItem(list=combine_3@L3)
if_3 = RefactoredIf(test=firstItem_13@L1, true=X_5@L2, false=Y_5@L2)
sortIndexByValue_3 = List.SortIndexByValue(list=if_3)

# group (continued): Get middle window
sortByKey_3 = List.SortByKey(list=flatten_15@L2, keys=sortIndexByValue_3@L2)
count_4 = List.Count(list=sortByKey_3.sortedList@L2)
chop_21 = List.Chop(list=count_4, lengths=code_block_56)
div_3 = chop_21@L2 / code_block_57
ceiling = Math.Ceiling(number=div_3)
sub = ceiling - code_block_58
getItemAtIndex_7 = List.GetItemAtIndex(list=sortByKey_3.sortedList@L2, index=sub@L2)
flatten_16 = List.Flatten(list=getItemAtIndex_7)
flatten_17 = List.Flatten(list=sortByKey_3.sortedList)
id_5 = Element.Id(element=flatten_17)
id_6 = Element.Id(element=flatten_16)
eq_25 = id_5@L1 == id_6
anyTrue_6 = List.AnyTrue(list=eq_25@L2)
filterByBoolMask_31 = List.FilterByBoolMask(list=flatten_17, mask=anyTrue_6)
list_create_8 = List.Create(item0=filterByBoolMask_31.out, item1=filterByBoolMask_30.out)
flatten_18 = List.Flatten(list=list_create_8)

# group: Headeer Count
code_block_60 = CodeBlock { "Header Count"; }
code_block_61 = CodeBlock { 2; }
ʳʰʸᵗʰᵐ_elements_14 = Rhythm.Revit.Elements.Elements.SetParameterByNameTypeOrInstance(element=flatten_16, parameterName=code_block_60, value=code_block_61)

# group: Headeer Count
code_block_62 = CodeBlock { "Header Count"; }
code_block_63 = CodeBlock { 0; }
ʳʰʸᵗʰᵐ_elements_15 = Rhythm.Revit.Elements.Elements.SetParameterByNameTypeOrInstance(element=flatten_18, parameterName=code_block_62, value=code_block_63)

# group: None
code_block_64 = CodeBlock { "Header Type"; }
ʳʰʸᵗʰᵐ_elements_16 = Rhythm.Revit.Elements.Elements.SetParameterByNameTypeOrInstance(element=flatten_18, parameterName=code_block_64, value=getItemAtIndex_6)

# group: Single door
categories_2 = Categories("OST_Doors")
all_family_types_of_category_2 = Custom[All Family Types Of Category](category=categories_2)
byFamilyType_2 = FamilyInstance.ByFamilyType(familyType=all_family_types_of_category_2)
flatten_19 = List.Flatten(list=byFamilyType_2)
code_block_65 = CodeBlock { "Function"; }
code_block_66 = CodeBlock { 0; }

# group: Remove door
getCategory_3 = Element.GetCategory(element=list_create_6)
string_from_object_7 = FromObject(object=getCategory_3)
code_block_67 = CodeBlock { "Doors"; }
eq_26 = string_from_object_7 == code_block_67
filterByBoolMask_32 = List.FilterByBoolMask(list=list_create_6, mask=eq_26)
flatten_20 = List.Flatten(list=filterByBoolMask_32.in)

# group: Remove multi door
id_7 = Element.Id(element=flatten_19)
id_8 = Element.Id(element=members_12)
id_9 = Element.Id(element=flatten_20)
list_create_9 = List.Create(item0=id_8, item1=id_9)
flatten_21 = List.Flatten(list=list_create_9)
eq_27 = id_7 == flatten_21  # lacing=CrossProduct
anyTrue_7 = List.AnyTrue(list=eq_27@L2)

# group (continued): Single door
filterByBoolMask_33 = List.FilterByBoolMask(list=flatten_19, mask=anyTrue_7)
ʳʰʸᵗʰᵐ_elements_17 = Rhythm.Revit.Elements.Elements.GetParameterValueByNameTypeOrInstance(element=filterByBoolMask_33.out, parameterName=code_block_65)
eq_28 = ʳʰʸᵗʰᵐ_elements_17 == code_block_66
filterByBoolMask_34 = List.FilterByBoolMask(list=filterByBoolMask_33.out, mask=eq_28)

# group: Bearing wall detect
element_host_2 = Custom[Element Host](element=filterByBoolMask_34.in)
code_block_68 = CodeBlock { "Wall Type"; }
ʳʰʸᵗʰᵐ_elements_18 = Rhythm.Revit.Elements.Elements.GetParameterValueByNameTypeOrInstance(element=element_host_2, parameterName=code_block_68)
code_block_69 = CodeBlock { "BEARING WALL"; }
eq_29 = ʳʰʸᵗʰᵐ_elements_18 == code_block_69
filterByBoolMask_35 = List.FilterByBoolMask(list=filterByBoolMask_34.in, mask=eq_29)
list_create_10 = List.Create(item0=filterByBoolMask_12.in, item1=filterByBoolMask_35.out)
flatten_22 = List.Flatten(list=list_create_10)

# group: Match Type
code_block_70 = CodeBlock { "Width"; }
ʳʰʸᵗʰᵐ_elements_19 = Rhythm.Revit.Elements.Elements.GetParameterValueByNameTypeOrInstance(element=flatten_22, parameterName=code_block_70)

# group: Dimentional 2X10 Filter
code_block_71 = CodeBlock(x=ʳʰʸᵗʰᵐ_elements_19) { x<=5.5; }
filterByBoolMask_36 = List.FilterByBoolMask(list=flatten_22, mask=code_block_71)
filterByBoolMask_37 = List.FilterByBoolMask(list=ʳʰʸᵗʰᵐ_elements_19, mask=code_block_71)

# group: LVL: 9-1/4"
code_block_72 = CodeBlock(x=filterByBoolMask_37.out) { x<=9.5; }
filterByBoolMask_38 = List.FilterByBoolMask(list=filterByBoolMask_36.out, mask=code_block_72)
filterByBoolMask_39 = List.FilterByBoolMask(list=filterByBoolMask_37.out, mask=code_block_72)

# group: LVL: 11-7/8" Filter
code_block_73 = CodeBlock(x=filterByBoolMask_39.out) { x<=15.5; }
filterByBoolMask_40 = List.FilterByBoolMask(list=filterByBoolMask_38.out, mask=code_block_73)
filterByBoolMask_41 = List.FilterByBoolMask(list=filterByBoolMask_39.out, mask=code_block_73)

# group: LVL: 14" Filter
code_block_74 = CodeBlock(x=filterByBoolMask_41.out) { x<=17.5; }
filterByBoolMask_42 = List.FilterByBoolMask(list=filterByBoolMask_40.out, mask=code_block_74)
filterByBoolMask_43 = List.FilterByBoolMask(list=filterByBoolMask_41.out, mask=code_block_74)

# group: LVL:16" Filter
code_block_75 = CodeBlock(x=filterByBoolMask_43.out) { x>17.6; }
filterByBoolMask_44 = List.FilterByBoolMask(list=filterByBoolMask_42.out, mask=code_block_75)
filterByBoolMask_45 = List.FilterByBoolMask(list=filterByBoolMask_41.out, mask=code_block_75)

# group: Non Bearing Header _No paradigm Defult_Type
code_block_76 = CodeBlock { "Header Type"; }
ʳʰʸᵗʰᵐ_elements_20 = Rhythm.Revit.Elements.Elements.GetParameterValueByNameTypeOrInstance(element=filterByBoolMask_44.in, parameterName=code_block_76)

# group: Non Bearing Header _No paradigm Defult_Type
code_block_77 = CodeBlock { "Header Type"; }
ʳʰʸᵗʰᵐ_elements_21 = Rhythm.Revit.Elements.Elements.GetParameterValueByNameTypeOrInstance(element=filterByBoolMask_42.in, parameterName=code_block_77)

# group: Non Bearing Header _No paradigm Defult_Type
code_block_78 = CodeBlock { "Header Type"; }
ʳʰʸᵗʰᵐ_elements_22 = Rhythm.Revit.Elements.Elements.GetParameterValueByNameTypeOrInstance(element=filterByBoolMask_40.in, parameterName=code_block_78)

# group: Non Bearing Header _No paradigm Defult_Type
code_block_79 = CodeBlock { "Header Type"; }
ʳʰʸᵗʰᵐ_elements_23 = Rhythm.Revit.Elements.Elements.GetParameterValueByNameTypeOrInstance(element=filterByBoolMask_38.in, parameterName=code_block_79)

# group: Non Bearing Header _No paradigm Defult_Type
code_block_80 = CodeBlock { "Header Type"; }
ʳʰʸᵗʰᵐ_elements_24 = Rhythm.Revit.Elements.Elements.GetParameterValueByNameTypeOrInstance(element=filterByBoolMask_36.in, parameterName=code_block_80)

# group: Non Bearing Header _No paradigm Defult_Count
code_block_81 = CodeBlock { "Header Count"; }
ʳʰʸᵗʰᵐ_elements_25 = Rhythm.Revit.Elements.Elements.GetParameterValueByNameTypeOrInstance(element=flatten_22, parameterName=code_block_81)

# group: If Case
non_bearing_header = BoolSelector(false)  # graph input
use_paradigm_defult_for_interior = BoolSelector(false)  # "Use Paradigm Defult (for Interior Doors)"; graph input
and_2 = And(bool0=non_bearing_header, bool1=use_paradigm_defult_for_interior)
code_block_82 = CodeBlock { 2; }
or_ = Or(bool0=non_bearing_header, bool1=use_paradigm_defult_for_interior)
code_block_83 = CodeBlock { 0; }
if_4 = RefactoredIf(test=or_, true=ʳʰʸᵗʰᵐ_elements_25, false=code_block_83)
if_5 = RefactoredIf(test=and_2, true=code_block_82, false=if_4)

# group: If Case
and_3 = And(bool0=non_bearing_header, bool1=use_paradigm_defult_for_interior)
or_2 = Or(bool0=non_bearing_header, bool1=use_paradigm_defult_for_interior)
if_6 = RefactoredIf(test=or_2, true=ʳʰʸᵗʰᵐ_elements_20, false=getItemAtIndex_6)
if_7 = RefactoredIf(test=and_3, true=getItemAtIndex_5, false=if_6)

# group: LVL:16"
code_block_84 = CodeBlock { "Header Type"; }
ʳʰʸᵗʰᵐ_elements_26 = Rhythm.Revit.Elements.Elements.SetParameterByNameTypeOrInstance(element=filterByBoolMask_44.in, parameterName=code_block_84, value=if_7)

# group: If Case
and_4 = And(bool0=non_bearing_header, bool1=use_paradigm_defult_for_interior)
or_3 = Or(bool0=non_bearing_header, bool1=use_paradigm_defult_for_interior)
if_8 = RefactoredIf(test=or_3, true=ʳʰʸᵗʰᵐ_elements_21, false=getItemAtIndex_6)
if_9 = RefactoredIf(test=and_4, true=getItemAtIndex_4, false=if_8)

# group: LVL: 14"
code_block_85 = CodeBlock { "Header Type"; }
ʳʰʸᵗʰᵐ_elements_27 = Rhythm.Revit.Elements.Elements.SetParameterByNameTypeOrInstance(element=filterByBoolMask_42.in, parameterName=code_block_85, value=if_9)

# group: If Case
and_5 = And(bool0=non_bearing_header, bool1=use_paradigm_defult_for_interior)
or_4 = Or(bool0=non_bearing_header, bool1=use_paradigm_defult_for_interior)
if_10 = RefactoredIf(test=or_4, true=ʳʰʸᵗʰᵐ_elements_22, false=getItemAtIndex_6)
if_11 = RefactoredIf(test=and_5, true=getItemAtIndex_3, false=if_10)

# group: LVL: 11-7/8"
code_block_86 = CodeBlock { "Header Type"; }
ʳʰʸᵗʰᵐ_elements_28 = Rhythm.Revit.Elements.Elements.SetParameterByNameTypeOrInstance(element=filterByBoolMask_40.in, parameterName=code_block_86, value=if_11)

# group: If Case
and_6 = And(bool0=non_bearing_header, bool1=use_paradigm_defult_for_interior)
or_5 = Or(bool0=non_bearing_header, bool1=use_paradigm_defult_for_interior)
if_12 = RefactoredIf(test=or_5, true=ʳʰʸᵗʰᵐ_elements_23, false=getItemAtIndex_6)
if_13 = RefactoredIf(test=and_6, true=getItemAtIndex_2, false=if_12)

# group: LVL: 9-1/4"
code_block_87 = CodeBlock { "Header Type"; }
ʳʰʸᵗʰᵐ_elements_29 = Rhythm.Revit.Elements.Elements.SetParameterByNameTypeOrInstance(element=filterByBoolMask_38.in, parameterName=code_block_87, value=if_13)

# group: If Case
and_7 = And(bool0=non_bearing_header, bool1=use_paradigm_defult_for_interior)
or_6 = Or(bool0=non_bearing_header, bool1=use_paradigm_defult_for_interior)
if_14 = RefactoredIf(test=or_6, true=ʳʰʸᵗʰᵐ_elements_24, false=getItemAtIndex_6)
if_15 = RefactoredIf(test=and_7, true=getItemAtIndex, false=if_14)

# group: Dimentional 2X10
code_block_88 = CodeBlock { "Header Type"; }
ʳʰʸᵗʰᵐ_elements_30 = Rhythm.Revit.Elements.Elements.SetParameterByNameTypeOrInstance(element=filterByBoolMask_36.in, parameterName=code_block_88, value=if_15)

# group: Headeer Count
code_block_89 = CodeBlock { "Header Count"; }
ʳʰʸᵗʰᵐ_elements_31 = Rhythm.Revit.Elements.Elements.SetParameterByNameTypeOrInstance(element=flatten_22, parameterName=code_block_89, value=if_5)

# group: Garage Filter
flatten_23 = List.Flatten(list=filterByBoolMask_34.out)
code_block_90 = CodeBlock { "Family"; }
ʳʰʸᵗʰᵐ_elements_32 = Rhythm.Revit.Elements.Elements.GetParameterValueByNameTypeOrInstance(element=flatten_23, parameterName=code_block_90)
string_from_object_8 = FromObject(object=ʳʰʸᵗʰᵐ_elements_32)
code_block_91 = CodeBlock { "GarageDoor"; }
contains = String.Contains(string=string_from_object_8, searchFor=code_block_91)
filterByBoolMask_46 = List.FilterByBoolMask(list=flatten_23, mask=contains)
list_create_11 = List.Create(item0=filterByBoolMask_35.in, item1=filterByBoolMask_46.out)
flatten_24 = List.Flatten(list=list_create_11)

# group: Family Data
type = archilab.Revit.Elements.Elements.Type(element=flatten_23)
parameters = Element.Parameters(element=type)
watch = Watch(parameters)
parameters_2 = Element.Parameters(element=flatten_23)
watch_2 = Watch(parameters_2)

# group: Match Type
code_block_92 = CodeBlock { "Width"; }
ʳʰʸᵗʰᵐ_elements_33 = Rhythm.Revit.Elements.Elements.GetParameterValueByNameTypeOrInstance(element=flatten_24, parameterName=code_block_92)

# group: Dimentional 2X10 Filter
code_block_93 = CodeBlock(x=ʳʰʸᵗʰᵐ_elements_33) { x<=5.5; }
filterByBoolMask_47 = List.FilterByBoolMask(list=flatten_24, mask=code_block_93)
filterByBoolMask_48 = List.FilterByBoolMask(list=ʳʰʸᵗʰᵐ_elements_33, mask=code_block_93)

# group: LVL: 9-1/4"
code_block_94 = CodeBlock(x=filterByBoolMask_48.out) { x<=9.5; }
filterByBoolMask_49 = List.FilterByBoolMask(list=filterByBoolMask_47.out, mask=code_block_94)
filterByBoolMask_50 = List.FilterByBoolMask(list=filterByBoolMask_48.out, mask=code_block_94)

# group: LVL: 9-1/4"
code_block_95 = CodeBlock { "Header Type"; }
ʳʰʸᵗʰᵐ_elements_34 = Rhythm.Revit.Elements.Elements.SetParameterByNameTypeOrInstance(element=filterByBoolMask_49.in, parameterName=code_block_95, value=getItemAtIndex_2)

# group: LVL: 11-7/8" Filter
code_block_96 = CodeBlock(x=filterByBoolMask_50.out) { x<=15.5; }
filterByBoolMask_51 = List.FilterByBoolMask(list=filterByBoolMask_49.out, mask=code_block_96)
filterByBoolMask_52 = List.FilterByBoolMask(list=filterByBoolMask_50.out, mask=code_block_96)

# group: LVL: 11-7/8"
code_block_97 = CodeBlock { "Header Type"; }
ʳʰʸᵗʰᵐ_elements_35 = Rhythm.Revit.Elements.Elements.SetParameterByNameTypeOrInstance(element=filterByBoolMask_51.in, parameterName=code_block_97, value=getItemAtIndex_3)

# group: LVL: 14" Filter
code_block_98 = CodeBlock(x=filterByBoolMask_52.out) { x<=17.5; }
filterByBoolMask_53 = List.FilterByBoolMask(list=filterByBoolMask_51.out, mask=code_block_98)
filterByBoolMask_54 = List.FilterByBoolMask(list=filterByBoolMask_52.out, mask=code_block_98)

# group: LVL: 14"
code_block_99 = CodeBlock { "Header Type"; }
ʳʰʸᵗʰᵐ_elements_36 = Rhythm.Revit.Elements.Elements.SetParameterByNameTypeOrInstance(element=filterByBoolMask_53.in, parameterName=code_block_99, value=getItemAtIndex_4)

# group: LVL:16" Filter
code_block_100 = CodeBlock(x=filterByBoolMask_54.out) { x>17.6; }
filterByBoolMask_55 = List.FilterByBoolMask(list=filterByBoolMask_53.out, mask=code_block_100)
filterByBoolMask_56 = List.FilterByBoolMask(list=filterByBoolMask_52.out, mask=code_block_100)

# group: LVL:16"
code_block_101 = CodeBlock { "Header Type"; }
ʳʰʸᵗʰᵐ_elements_37 = Rhythm.Revit.Elements.Elements.SetParameterByNameTypeOrInstance(element=filterByBoolMask_55.in, parameterName=code_block_101, value=getItemAtIndex_5)

# group: Dimentional 2X10
code_block_102 = CodeBlock { "Header Type"; }
ʳʰʸᵗʰᵐ_elements_38 = Rhythm.Revit.Elements.Elements.SetParameterByNameTypeOrInstance(element=filterByBoolMask_47.in, parameterName=code_block_102, value=getItemAtIndex)

# group: Headeer Count
code_block_103 = CodeBlock { "Header Count"; }
code_block_104 = CodeBlock { 2; }
ʳʰʸᵗʰᵐ_elements_39 = Rhythm.Revit.Elements.Elements.SetParameterByNameTypeOrInstance(element=flatten_24, parameterName=code_block_103, value=code_block_104)

# group: Headeer Count
code_block_105 = CodeBlock { "Header Count"; }
code_block_106 = CodeBlock { 2; }
ʳʰʸᵗʰᵐ_elements_40 = Rhythm.Revit.Elements.Elements.SetParameterByNameTypeOrInstance(element=filterByBoolMask_46.in, parameterName=code_block_105, value=code_block_106)

# group: Match Type
code_block_107 = CodeBlock { "Width"; }
ʳʰʸᵗʰᵐ_elements_41 = Rhythm.Revit.Elements.Elements.GetParameterValueByNameTypeOrInstance(element=filterByBoolMask_46.in, parameterName=code_block_107)

# group: LVL: 11-7/8" Filter
code_block_108 = CodeBlock(x=ʳʰʸᵗʰᵐ_elements_41) { x<=16; }
filterByBoolMask_57 = List.FilterByBoolMask(list=ʳʰʸᵗʰᵐ_elements_41, mask=code_block_108)
filterByBoolMask_58 = List.FilterByBoolMask(list=filterByBoolMask_46.in, mask=code_block_108)

# group: LVL: 14" Filter
code_block_109 = CodeBlock(x=filterByBoolMask_57.out) { x<=18; }
filterByBoolMask_59 = List.FilterByBoolMask(list=filterByBoolMask_57.out, mask=code_block_109)
filterByBoolMask_60 = List.FilterByBoolMask(list=filterByBoolMask_58.out, mask=code_block_109)

# group: LVL:16" Filter
code_block_110 = CodeBlock(x=filterByBoolMask_59.out) { x>20; }
filterByBoolMask_61 = List.FilterByBoolMask(list=filterByBoolMask_57.out, mask=code_block_110)
filterByBoolMask_62 = List.FilterByBoolMask(list=filterByBoolMask_60.out, mask=code_block_110)

# group: LVL:16"
code_block_111 = CodeBlock { "Header Type"; }
ʳʰʸᵗʰᵐ_elements_42 = Rhythm.Revit.Elements.Elements.SetParameterByNameTypeOrInstance(element=filterByBoolMask_62.in, parameterName=code_block_111, value=getItemAtIndex_5)

# group: LVL: 14"
code_block_112 = CodeBlock { "Header Type"; }
ʳʰʸᵗʰᵐ_elements_43 = Rhythm.Revit.Elements.Elements.SetParameterByNameTypeOrInstance(element=filterByBoolMask_60.in, parameterName=code_block_112, value=getItemAtIndex_4)

# group: LVL: 11-7/8"
code_block_113 = CodeBlock { "Header Type"; }
ʳʰʸᵗʰᵐ_elements_44 = Rhythm.Revit.Elements.Elements.SetParameterByNameTypeOrInstance(element=filterByBoolMask_58.in, parameterName=code_block_113, value=getItemAtIndex_3)

# group: Window Base Line
getLocation_17 = Element.GetLocation(element=filterByBoolMask_30.in)
list_create_12 = List.Create()  # unwired: item0, item1, item2, item3
code_block_114 = CodeBlock { "Width"; }
ʳʰʸᵗʰᵐ_elements_45 = Rhythm.Revit.Elements.Elements.GetParameterValueByNameTypeOrInstance(element=filterByBoolMask_30.in, parameterName=code_block_114)
code_block_115 = CodeBlock { 2; }
div_4 = ʳʰʸᵗʰᵐ_elements_45 / code_block_115
code_block_116 = CodeBlock { 2; }
code_block_117 = CodeBlock { 2; }
code_block_118 = CodeBlock { 1; }

# group: Get Vector
X_6 = Point.X(point=getLocation_17)
Y_6 = Point.Y(point=getLocation_17)
Z_10 = Point.Z(point=getLocation_17)
byCoordinates_3 = Vector.ByCoordinates(x=X_6, y=Y_6, z=Z_10)
element_host_3 = Custom[Element Host](element=filterByBoolMask_30.in@L2)
ʳʰʸᵗʰᵐ_hostobject = Rhythm.Revit.Elements.HostObject.ExteriorSurface(hostObject=element_host_3)
principalDirectionsAtParameter = Surface.PrincipalDirectionsAtParameter(surface=ʳʰʸᵗʰᵐ_hostobject)
lastItem = List.LastItem(list=principalDirectionsAtParameter)
tangentAtVParameter = Surface.TangentAtVParameter(surface=ʳʰʸᵗʰᵐ_hostobject)

# group (continued): Window Base Line
reverse = Vector.Reverse(vector=tangentAtVParameter)
byStartPointDirectionLength = Line.ByStartPointDirectionLength(startPoint=getLocation_17, direction=reverse, length=div_4)
flatten_25 = List.Flatten(list=byStartPointDirectionLength@L4, amount=code_block_116)
startPoint = Curve.StartPoint(curve=flatten_25)
endPoint = Curve.EndPoint(curve=flatten_25)
byStartPointDirectionLength_2 = Line.ByStartPointDirectionLength(startPoint=getLocation_17, direction=tangentAtVParameter, length=div_4)
flatten_26 = List.Flatten(list=byStartPointDirectionLength_2@L4, amount=code_block_117)
endPoint_2 = Curve.EndPoint(curve=flatten_26)
startPoint_2 = Curve.StartPoint(curve=flatten_26)
combine_4 = List.Combine(combineFunction=list_create_12, list0=startPoint, list1=endPoint, list2=endPoint_2, list3=startPoint_2)
flatten_27 = List.Flatten(list=combine_4@L3, amount=code_block_118)
byBestFitThroughPoints_3 = Line.ByBestFitThroughPoints(bestFitPoints=flatten_27)

# group: Width
length_5 = Curve.Length(curve=byBestFitThroughPoints_3)
code_block_119 = CodeBlock { "Width"; }

# group: Dimentional 2X10 Filter
code_block_120 = CodeBlock(x=length_5) { x<=5.5; }
filterByBoolMask_63 = List.FilterByBoolMask(list=length_5, mask=code_block_120)
filterByBoolMask_64 = List.FilterByBoolMask(list=flatten_16, mask=code_block_120)

# group: LVL: 9-1/4"
code_block_121 = CodeBlock(x=filterByBoolMask_63.out) { x<=9.5; }
filterByBoolMask_65 = List.FilterByBoolMask(list=filterByBoolMask_63.out, mask=code_block_121)
filterByBoolMask_66 = List.FilterByBoolMask(list=filterByBoolMask_64.out, mask=code_block_121)

# group: LVL: 11-7/8" Filter
code_block_122 = CodeBlock(x=filterByBoolMask_65.out) { x<=15.5; }
filterByBoolMask_67 = List.FilterByBoolMask(list=filterByBoolMask_65.out, mask=code_block_122)
filterByBoolMask_68 = List.FilterByBoolMask(list=filterByBoolMask_66.out, mask=code_block_122)

# group: LVL: 14" Filter
code_block_123 = CodeBlock(x=filterByBoolMask_67.out) { x<=17.5; }
filterByBoolMask_69 = List.FilterByBoolMask(list=filterByBoolMask_67.out, mask=code_block_123)
filterByBoolMask_70 = List.FilterByBoolMask(list=filterByBoolMask_68.out, mask=code_block_123)

# group: LVL:16" Filter
code_block_124 = CodeBlock(x=filterByBoolMask_69.out) { x>17.6; }
filterByBoolMask_71 = List.FilterByBoolMask(list=filterByBoolMask_67.out, mask=code_block_124)
filterByBoolMask_72 = List.FilterByBoolMask(list=filterByBoolMask_70.out, mask=code_block_124)

# group: LVL:16"
code_block_125 = CodeBlock { "Header Type"; }
ʳʰʸᵗʰᵐ_elements_46 = Rhythm.Revit.Elements.Elements.SetParameterByNameTypeOrInstance(element=filterByBoolMask_72.in, parameterName=code_block_125, value=getItemAtIndex_5)

# group: LVL: 14"
code_block_126 = CodeBlock { "Header Type"; }
ʳʰʸᵗʰᵐ_elements_47 = Rhythm.Revit.Elements.Elements.SetParameterByNameTypeOrInstance(element=filterByBoolMask_70.in, parameterName=code_block_126, value=getItemAtIndex_4)

# group: LVL: 11-7/8"
code_block_127 = CodeBlock { "Header Type"; }
ʳʰʸᵗʰᵐ_elements_48 = Rhythm.Revit.Elements.Elements.SetParameterByNameTypeOrInstance(element=filterByBoolMask_68.in, parameterName=code_block_127, value=getItemAtIndex_3)

# group: LVL: 9-1/4"
code_block_128 = CodeBlock { "Header Type"; }
ʳʰʸᵗʰᵐ_elements_49 = Rhythm.Revit.Elements.Elements.SetParameterByNameTypeOrInstance(element=filterByBoolMask_66.in, parameterName=code_block_128, value=getItemAtIndex_2)

# group: Dimentional 2X10
code_block_129 = CodeBlock { "Header Type"; }
ʳʰʸᵗʰᵐ_elements_50 = Rhythm.Revit.Elements.Elements.SetParameterByNameTypeOrInstance(element=filterByBoolMask_64.in, parameterName=code_block_129, value=getItemAtIndex)
