# Dynamo graph Auto Header V 1.1.dyn (Dynamo 2.16.2.5624)
# packages: Clockwork for Dynamo 2.x 2.6.0, Rhythm 2023.9.1, archi-lab.net 2024.217.1024

# group: Windows Control
categories = Categories("OST_Windows")
all_family_types_of_category = Custom[All Family Types Of Category](category=categories)  # package Clockwork for Dynamo 2.x; Gets all family types/symbols of a given category in the model.
name = Element.Name(element=all_family_types_of_category)
length = String.Length(string=name)
code_block = CodeBlock { 4; }
eq = length == code_block
filterByBoolMask = List.FilterByBoolMask(list=all_family_types_of_category, mask=eq)
name_2 = Element.Name(element=filterByBoolMask.out)
length_2 = String.Length(string=name_2)
code_block_2 = CodeBlock { 9; }
eq_2 = length_2 == code_block_2
filterByBoolMask_2 = List.FilterByBoolMask(list=filterByBoolMask.out, mask=eq_2)
name_3 = Element.Name(element=filterByBoolMask_2.out)
number_slider = DoubleSlider(0, range=0..10 step 1)
number_slider_2 = DoubleSlider(4, range=0..10 step 1)
substring = String.Substring(string=name_3, startIndex=number_slider, length=number_slider_2)
code_block_3 = CodeBlock { "Main"; }
eq_3 = substring == code_block_3
filterByBoolMask_3 = List.FilterByBoolMask(list=filterByBoolMask_2.out, mask=eq_3)

# group: Main Trim Data
code_block_4 = CodeBlock { "Window Height"; }
ʳʰʸᵗʰᵐ_elements = Rhythm.Revit.Elements.Elements.SetParameterByNameTypeOrInstance(parameterName=code_block_4)  # unwired: element, value
code_block_5 = CodeBlock { "Window Width"; }
ʳʰʸᵗʰᵐ_elements_2 = Rhythm.Revit.Elements.Elements.SetParameterByNameTypeOrInstance(parameterName=code_block_5)  # unwired: element, value

# group: Multiple Window
all_elements_in_active_view = ElementsInView()
string_from_object = FromObject(object=all_elements_in_active_view)
code_block_6 = CodeBlock { "AssemblyInstance"; }
eq_4 = string_from_object == code_block_6
filterByBoolMask_4 = List.FilterByBoolMask(list=all_elements_in_active_view, mask=eq_4)
members = Custom[Assembly.Members](assembly=filterByBoolMask_4.in)  # package Clockwork for Dynamo 2.x; Retrieves the members of an assembly
string_from_object_2 = FromObject(object=members)
code_block_7 = CodeBlock { "Main"; }
code_block_8 = CodeBlock { "Secondary"; }
list_create = List.Create(item0=code_block_7, item1=code_block_8)
eq_5 = string_from_object_2 == list_create  # lacing=CrossProduct
anyTrue = Custom[Booleans.AnyTrue](seq=eq_5)  # package Clockwork for Dynamo 2.x; Returns true if any item in a list of booleans is true. ATTENTION: This node will be deprecated in 2024. As of Revit 2022, please switch to the OOTB node AnyTrue.
anyTrue_2 = List.AnyTrue(list=anyTrue@L2)
filterByBoolMask_5 = List.FilterByBoolMask(list=filterByBoolMask_4.in, mask=anyTrue_2)
members_2 = Custom[Assembly.Members](assembly=filterByBoolMask_5.in)

# group: Single Windows
categories_2 = Categories("OST_Windows")
all_family_types_of_category_2 = Custom[All Family Types Of Category](category=categories_2)
byFamilyType = FamilyInstance.ByFamilyType(familyType=all_family_types_of_category_2)
flatten = List.Flatten(list=byFamilyType)
id = Element.Id(element=flatten)
id_2 = Element.Id(element=members_2)
flatten_2 = List.Flatten(list=id_2)
eq_6 = id == flatten_2  # lacing=CrossProduct
anyTrue_3 = List.AnyTrue(list=eq_6@L2)
filterByBoolMask_6 = List.FilterByBoolMask(list=flatten, mask=anyTrue_3)
count = List.Count(list=filterByBoolMask_6.in)
count_2 = List.Count(list=flatten_2)

select_model_element = DSModelElementSelection()  # 1 picked in the model
code_block_9 = CodeBlock { "Header Type"; }
ʳʰʸᵗʰᵐ_elements_3 = Rhythm.Revit.Elements.Elements.GetParameterValueByNameTypeOrInstance(element=select_model_element, parameterName=code_block_9)

# group: Headeer Count
code_block_10 = CodeBlock { "Header Count"; }
ʳʰʸᵗʰᵐ_elements_4 = Rhythm.Revit.Elements.Elements.SetParameterByNameTypeOrInstance(element=filterByBoolMask_6.out, parameterName=code_block_10, value=ʳʰʸᵗʰᵐ_elements_3)
code_block_11 = CodeBlock { 2; }

# group: Match Type
code_block_12 = CodeBlock { "Width"; }
ʳʰʸᵗʰᵐ_elements_5 = Rhythm.Revit.Elements.Elements.GetParameterValueByNameTypeOrInstance(element=filterByBoolMask_6.out, parameterName=code_block_12)

# group: Dimentional 2X10 Filter
code_block_13 = CodeBlock(x=ʳʰʸᵗʰᵐ_elements_5) { x<=5.5; }
filterByBoolMask_7 = List.FilterByBoolMask(list=filterByBoolMask_6.out, mask=code_block_13)
filterByBoolMask_8 = List.FilterByBoolMask(list=ʳʰʸᵗʰᵐ_elements_5, mask=code_block_13)

# group: Dimentional 2X10
code_block_14 = CodeBlock { "DIMENSIONAL : 2x10"; }
code_block_15 = CodeBlock { "Header Type"; }
ʳʰʸᵗʰᵐ_elements_6 = Rhythm.Revit.Elements.Elements.SetParameterByNameTypeOrInstance(element=filterByBoolMask_7.in, parameterName=code_block_15)  # unwired: value

# group: LVL: 9-1/4"
code_block_16 = CodeBlock(x=filterByBoolMask_8.out) { x<=9.5; }
filterByBoolMask_9 = List.FilterByBoolMask(list=filterByBoolMask_7.out, mask=code_block_16)
filterByBoolMask_10 = List.FilterByBoolMask(list=filterByBoolMask_8.out, mask=code_block_16)

# group: LVL: 9-1/4"
code_block_17 = CodeBlock { "Header Type"; }
code_block_18 = CodeBlock { "LVL: 9-1/4"; }
ʳʰʸᵗʰᵐ_elements_7 = Rhythm.Revit.Elements.Elements.SetParameterByNameTypeOrInstance(element=filterByBoolMask_9.in, parameterName=code_block_17, value=code_block_18)

# group: LVL: 11-7/8" Filter
code_block_19 = CodeBlock(x=filterByBoolMask_10.out) { x<=15.5; }
filterByBoolMask_11 = List.FilterByBoolMask(list=filterByBoolMask_9.out, mask=code_block_19)
filterByBoolMask_12 = List.FilterByBoolMask(list=filterByBoolMask_10.out, mask=code_block_19)

code_block_20 = CodeBlock { "Header Type"; }

# group: LVL: 11-7/8"
code_block_21 = CodeBlock { "LVL: 11-7/8"; }
ʳʰʸᵗʰᵐ_elements_8 = Rhythm.Revit.Elements.Elements.SetParameterByNameTypeOrInstance(element=filterByBoolMask_11.in, parameterName=code_block_20, value=code_block_21)

# group: LVL: 14" Filter
code_block_22 = CodeBlock(x=filterByBoolMask_12.out) { x<=17.5; }
filterByBoolMask_13 = List.FilterByBoolMask(list=filterByBoolMask_11.out, mask=code_block_22)
filterByBoolMask_14 = List.FilterByBoolMask(list=filterByBoolMask_12.out, mask=code_block_22)

# group: LVL: 14"
code_block_23 = CodeBlock { "Header Type"; }
code_block_24 = CodeBlock { "LVL: 14"; }
ʳʰʸᵗʰᵐ_elements_9 = Rhythm.Revit.Elements.Elements.SetParameterByNameTypeOrInstance(element=filterByBoolMask_13.in, parameterName=code_block_23, value=code_block_24)

# group: LVL:16" Filter
code_block_25 = CodeBlock(x=filterByBoolMask_14.out) { x>17.6; }
filterByBoolMask_15 = List.FilterByBoolMask(list=filterByBoolMask_13.out, mask=code_block_25)
filterByBoolMask_16 = List.FilterByBoolMask(list=filterByBoolMask_12.out, mask=code_block_25)

code_block_26 = CodeBlock { "Header Type"; }

# group: LVL:16"
code_block_27 = CodeBlock { "LVL:16"; }
ʳʰʸᵗʰᵐ_elements_10 = Rhythm.Revit.Elements.Elements.SetParameterByNameTypeOrInstance(element=filterByBoolMask_15.in, parameterName=code_block_26, value=code_block_27)

# group: Family Data
type = archilab.Revit.Elements.Elements.Type(element=select_model_element)
parameters = Element.Parameters(element=type)
watch = Watch(parameters)
parameters_2 = Element.Parameters(element=select_model_element)
watch_2 = Watch(parameters_2)

categories_3 = Categories("OST_Windows")
all_elements_of_category = ElementsOfCategory(Category=categories_3)
getParameterValueByName = Element.GetParameterValueByName(element=all_elements_of_category, parameterName=code_block_9)
