# Dynamo graph Auto Header V 1.15.dyn (Dynamo 2.16.2.5624)
# packages: Clockwork for Dynamo 2.x 2.6.0, Rhythm 2023.9.1, archi-lab.net 2024.217.1024, SteamNodes 1.2.4, Genius Loci 2023.7.13

# group: Windows Control
categories = Categories("OST_Windows")
all_family_types_of_category = Custom[All Family Types Of Category](category=categories)  # package Clockwork for Dynamo 2.x; Gets all family types/symbols of a given category in the model.
name = Element.Name(element=all_family_types_of_category)
length = String.Length(string=name)
code_block = CodeBlock { 4; }
eq = length == code_block
filterByBoolMask = List.FilterByBoolMask(list=all_family_types_of_category, mask=eq)
name_2 = Element.Name(element=filterByBoolMask.out)
length_2 = String.Length(string=name_2)
code_block_2 = CodeBlock { 9; }
eq_2 = length_2 == code_block_2
filterByBoolMask_2 = List.FilterByBoolMask(list=filterByBoolMask.out, mask=eq_2)
name_3 = Element.Name(element=filterByBoolMask_2.out)
number_slider = DoubleSlider(0, range=0..10 step 1)
number_slider_2 = DoubleSlider(4, range=0..10 step 1)
substring = String.Substring(string=name_3, startIndex=number_slider, length=number_slider_2)
code_block_3 = CodeBlock { "Main"; }
eq_3 = substring == code_block_3
filterByBoolMask_3 = List.FilterByBoolMask(list=filterByBoolMask_2.out, mask=eq_3)

# group: Main Trim Data
code_block_4 = CodeBlock { "Window Height"; }
ʳʰʸᵗʰᵐ_elements = Rhythm.Revit.Elements.Elements.SetParameterByNameTypeOrInstance(parameterName=code_block_4)  # unwired: element, value
code_block_5 = CodeBlock { "Window Width"; }
ʳʰʸᵗʰᵐ_elements_2 = Rhythm.Revit.Elements.Elements.SetParameterByNameTypeOrInstance(parameterName=code_block_5)  # unwired: element, value

# group: Multiple Window
all_elements_in_active_view = ElementsInView()
string_from_object = FromObject(object=all_elements_in_active_view)
code_block_6 = CodeBlock { "AssemblyInstance"; }
eq_4 = string_from_object == code_block_6
filterByBoolMask_4 = List.FilterByBoolMask(list=all_elements_in_active_view, mask=eq_4)
members = Custom[Assembly.Members](assembly=filterByBoolMask_4.in)  # package Clockwork for Dynamo 2.x; Retrieves the members of an assembly
string_from_object_2 = FromObject(object=members)
code_block_7 = CodeBlock { "Main"; }
code_block_8 = CodeBlock { "Secondary"; }
list_create = List.Create(item0=code_block_7, item1=code_block_8)
eq_5 = string_from_object_2 == list_create  # lacing=CrossProduct
anyTrue = Custom[Booleans.AnyTrue](seq=eq_5)  # package Clockwork for Dynamo 2.x; Returns true if any item in a list of booleans is true. ATTENTION: This node will be deprecated in 2024. As of Revit 2022, please switch to the OOTB node AnyTrue.
anyTrue_2 = List.AnyTrue(list=anyTrue@L2)
filterByBoolMask_5 = List.FilterByBoolMask(list=filterByBoolMask_4.in, mask=anyTrue_2)
members_2 = Custom[Assembly.Members](assembly=filterByBoolMask_5.in)

# group: Single Windows
categories_2 = Categories("OST_Windows")
all_family_types_of_category_2 = Custom[All Family Types Of Category](category=categories_2)
byFamilyType = FamilyInstance.ByFamilyType(familyType=all_family_types_of_category_2)
flatten = List.Flatten(list=byFamilyType)
id = Element.Id(element=flatten)
id_2 = Element.Id(element=members_2)
flatten_2 = List.Flatten(list=id_2)
eq_6 = id == flatten_2  # lacing=CrossProduct
anyTrue_3 = List.AnyTrue(list=eq_6@L2)
filterByBoolMask_6 = List.FilterByBoolMask(list=flatten, mask=anyTrue_3)
count = List.Count(list=filterByBoolMask_6.in)
count_2 = List.Count(list=flatten_2)

# group: Headeer Count
code_block_9 = CodeBlock { "Header Count"; }
ʳʰʸᵗʰᵐ_elements_3 = Rhythm.Revit.Elements.Elements.SetParameterByNameTypeOrInstance(element=filterByBoolMask_6.out, parameterName=code_block_9)  # unwired: value
code_block_10 = CodeBlock { 2; }

# group: Match Type
code_block_11 = CodeBlock { "Width"; }
ʳʰʸᵗʰᵐ_elements_4 = Rhythm.Revit.Elements.Elements.GetParameterValueByNameTypeOrInstance(element=filterByBoolMask_6.out, parameterName=code_block_11)

# group: Dimentional 2X10 Filter
code_block_12 = CodeBlock(x=ʳʰʸᵗʰᵐ_elements_4) { x<=5.5; }
filterByBoolMask_7 = List.FilterByBoolMask(list=filterByBoolMask_6.out, mask=code_block_12)
filterByBoolMask_8 = List.FilterByBoolMask(list=ʳʰʸᵗʰᵐ_elements_4, mask=code_block_12)

# group: Dimentional 2X10
code_block_13 = CodeBlock { "DIMENSIONAL : 2x10"; }
code_block_14 = CodeBlock { "Header Type"; }
ʳʰʸᵗʰᵐ_elements_5 = Rhythm.Revit.Elements.Elements.SetParameterByNameTypeOrInstance(element=filterByBoolMask_7.in, parameterName=code_block_14)  # unwired: value

# group: LVL: 9-1/4"
code_block_15 = CodeBlock(x=filterByBoolMask_8.out) { x<=9.5; }
filterByBoolMask_9 = List.FilterByBoolMask(list=filterByBoolMask_7.out, mask=code_block_15)
filterByBoolMask_10 = List.FilterByBoolMask(list=filterByBoolMask_8.out, mask=code_block_15)

# group: LVL: 9-1/4"
code_block_16 = CodeBlock { "Header Type"; }
code_block_17 = CodeBlock { "LVL: 9-1/4"; }
ʳʰʸᵗʰᵐ_elements_6 = Rhythm.Revit.Elements.Elements.SetParameterByNameTypeOrInstance(element=filterByBoolMask_9.in, parameterName=code_block_16, value=code_block_17)

# group: LVL: 11-7/8" Filter
code_block_18 = CodeBlock(x=filterByBoolMask_10.out) { x<=15.5; }
filterByBoolMask_11 = List.FilterByBoolMask(list=filterByBoolMask_9.out, mask=code_block_18)
filterByBoolMask_12 = List.FilterByBoolMask(list=filterByBoolMask_10.out, mask=code_block_18)

code_block_19 = CodeBlock { "Header Type"; }

# group: LVL: 11-7/8"
code_block_20 = CodeBlock { "LVL: 11-7/8"; }
ʳʰʸᵗʰᵐ_elements_7 = Rhythm.Revit.Elements.Elements.SetParameterByNameTypeOrInstance(element=filterByBoolMask_11.in, parameterName=code_block_19, value=code_block_20)

# group: LVL: 14" Filter
code_block_21 = CodeBlock(x=filterByBoolMask_12.out) { x<=17.5; }
filterByBoolMask_13 = List.FilterByBoolMask(list=filterByBoolMask_11.out, mask=code_block_21)
filterByBoolMask_14 = List.FilterByBoolMask(list=filterByBoolMask_12.out, mask=code_block_21)

# group: LVL: 14"
code_block_22 = CodeBlock { "Header Type"; }
code_block_23 = CodeBlock { "LVL: 14"; }
ʳʰʸᵗʰᵐ_elements_8 = Rhythm.Revit.Elements.Elements.SetParameterByNameTypeOrInstance(element=filterByBoolMask_13.in, parameterName=code_block_22, value=code_block_23)

# group: LVL:16" Filter
code_block_24 = CodeBlock(x=filterByBoolMask_14.out) { x>17.6; }
filterByBoolMask_15 = List.FilterByBoolMask(list=filterByBoolMask_13.out, mask=code_block_24)
filterByBoolMask_16 = List.FilterByBoolMask(list=filterByBoolMask_12.out, mask=code_block_24)

code_block_25 = CodeBlock { "Header Type"; }

# group: LVL:16"
code_block_26 = CodeBlock { "LVL:16"; }
ʳʰʸᵗʰᵐ_elements_9 = Rhythm.Revit.Elements.Elements.SetParameterByNameTypeOrInstance(element=filterByBoolMask_15.in, parameterName=code_block_25, value=code_block_26)

select_model_element = DSModelElementSelection()  # 1 picked in the model

# group: Family Data
type = archilab.Revit.Elements.Elements.Type(element=select_model_element)
parameters = Element.Parameters(element=type)
watch = Watch(parameters)
parameters_2 = Element.Parameters(element=select_model_element)
watch_2 = Watch(parameters_2)

select_model_element_2 = DSModelElementSelection()  # 1 picked in the model
code_block_27 = CodeBlock { "Header Type"; }
ʳʰʸᵗʰᵐ_elements_10 = Rhythm.Revit.Elements.Elements.GetParameterValueByNameTypeOrInstance(element=select_model_element_2, parameterName=code_block_27)
categories_3 = Categories("OST_Windows")
all_elements_of_category = ElementsOfCategory(Category=categories_3)
getParameterValueByName = Element.GetParameterValueByName(element=all_elements_of_category)  # unwired: parameterName
ruleId = PerformanceAdviserRule.RuleId()  # unwired: performanceAdviserRule
id_3 = Element.Id()  # unwired: element
id_4 = Category.Id()  # unwired: category

# group: Get Vertical / Horizontal Trim
string = StringInput("WTS_InteriorDoor_SinglePanel_Swing_Flush")
byName = Family.ByName(name=string)
types = Family.Types(family=byName)
family = FamilyType.Family(familyType=types)

code_block_28 = CodeBlock { "Header Type"; }
ʳʰʸᵗʰᵐ_elements_11 = Rhythm.Revit.Elements.Elements.GetParameterValueByNameTypeOrInstance(element=family, parameterName=code_block_28)
select_model_element_3 = DSModelElementSelection()  # 1 picked in the model
select_model_element_4 = DSModelElementSelection()  # 1 picked in the model
code_block_29 = CodeBlock { "Header Type"; }
ʳʰʸᵗʰᵐ_elements_12 = Rhythm.Revit.Elements.Elements.GetParameterValueByNameTypeOrInstance(element=select_model_element_4, parameterName=code_block_29)
select_model_element_5 = DSModelElementSelection()  # 1 picked in the model
code_block_30 = CodeBlock { "Header Type"; }
ʳʰʸᵗʰᵐ_elements_13 = Rhythm.Revit.Elements.Elements.GetParameterValueByNameTypeOrInstance(element=select_model_element_5, parameterName=code_block_30)
select_model_element_6 = DSModelElementSelection()  # 1 picked in the model
code_block_31 = CodeBlock { "Header Type"; }
ʳʰʸᵗʰᵐ_elements_14 = Rhythm.Revit.Elements.Elements.GetParameterValueByNameTypeOrInstance(element=select_model_element_6, parameterName=code_block_31)
select_model_element_7 = DSModelElementSelection()  # 1 picked in the model
code_block_32 = CodeBlock { "Header Type"; }
ʳʰʸᵗʰᵐ_elements_15 = Rhythm.Revit.Elements.Elements.GetParameterValueByNameTypeOrInstance(element=select_model_element_7, parameterName=code_block_32)
list_create_2 = List.Create()  # unwired: item0, item1, item2, item3, item4
code_block_33 = CodeBlock { 4; }
getParameterValueByName_2 = Element.GetParameterValueByName(element=select_model_element_6, parameterName=code_block_31)
getCategory = Element.GetCategory(element=getParameterValueByName_2)
all_elements_of_category_2 = ElementsOfCategory(Category=getCategory)
id_5 = Element.Id(element=all_elements_of_category_2)
id_6 = Element.Id(element=getParameterValueByName_2)
eq_7 = id_5 == id_6
filterByBoolMask_17 = List.FilterByBoolMask(list=all_elements_of_category_2, mask=eq_7)
code_block_34 = CodeBlock { 10; }
setParameterByName = Element.SetParameterByName(element=getParameterValueByName_2, parameterName=code_block_31, value=code_block_34)
elementType = Element.ElementType(element=getParameterValueByName_2)
parameters_3 = Element.Parameters(element=getParameterValueByName_2)
byName_2 = ElementType.ByName()  # unwired: name
setParameterByName_2 = Element.SetParameterByName(element=select_model_element_6, parameterName=code_block_31)  # unwired: value
select_model_element_8 = DSModelElementSelection()  # nothing selected
code_block_35 = CodeBlock { "Header Type"; }
ʳʰʸᵗʰᵐ_elements_16 = Rhythm.Revit.Elements.Elements.GetParameterValueByNameTypeOrInstance(element=select_model_element_8, parameterName=code_block_35)
byFamilyType_2 = FamilyInstance.ByFamilyType(familyType=types)
byFamilyNameAndTypeName = FamilyType.ByFamilyNameAndTypeName()  # unwired: familyName, typeName
get_type_parameter = Custom[Get Type Parameter]()  # package archi-lab.net; This node will retrieve a type parameter by its name.; unwired: element, parameterName
byFamilyAndName = FamilyType.ByFamilyAndName()  # unwired: family, name
view_family_types = ViewFamilyTypes()  # nothing selected
typeName = Custom[Element.TypeName]()  # package SteamNodes; Get Type Name as string; unwired: Element
name_4 = Family.Name(family=family)
types_2 = Family.Types()  # unwired: family

# group: Get Vertical / Horizontal Trim
string_2 = StringInput("WTS_InteriorDoor_SinglePanel_Swing_Flush")
byName_3 = Family.ByName(name=string_2)
types_3 = Family.Types(family=byName_3)
family_2 = FamilyType.Family(familyType=types_3)

familyDocument = Family.FamilyDocument(family=family_2)
familydocument_parameters = Custom[FamilyDocument Parameters](familydocument=familyDocument)  # package Genius Loci; Retrieves all family parameters from the given or active family document.
get_family_parameter = FamilyInstanceParameters(f=types_3)  # nothing selected
byFamilyType_3 = FamilyInstance.ByFamilyType()  # unwired: familyType
code_block_36 = CodeBlock { "Header Type"; }
getParameterValueByName_3 = Element.GetParameterValueByName(element=types_3, parameterName=code_block_36)
ʳʰʸᵗʰᵐ_elements_17 = Rhythm.Revit.Elements.Elements.GetParameterValueByNameTypeOrInstance(element=family_2, parameterName=code_block_36)
select_model_element_9 = DSModelElementSelection()  # nothing selected
getValueByFamilyType = Custom[FamilyParameter.GetValueByFamilyType](familyParameter=code_block_36, familyType=types_3)  # package Clockwork for Dynamo 2.x; Returns the value of a family parameter for a given family type
boolean = BoolSelector(true)
familyParameters = Custom[FamilyDocument.FamilyParameters](toggle=boolean)  # package Clockwork for Dynamo 2.x; Retrieves all family parameters from the active family document. PLEASE NOTE: This node will only work in a family document!
string_from_object_3 = FromObject(object=types_3)
getParameterValueByName_4 = FamilyDocument.GetParameterValueByName(familyDocument=familyDocument, familyTypeName=string_from_object_3)  # unwired: parameterName
parameters_4 = FamilyDocument.Parameters(familyDocument=familyDocument)
name_5 = FamilyParameter.Name(familyParameter=parameters_4)
code_block_37 = CodeBlock { "Header Type"; }
eq_8 = name_5 == code_block_37
filterByBoolMask_18 = List.FilterByBoolMask(list=parameters_4, mask=eq_8)
flatten_3 = List.Flatten(list=filterByBoolMask_18.in)
name_6 = FamilyParameter.Name(familyParameter=flatten_3)
isShared = FamilyParameter.IsShared(familyParameter=flatten_3)
specType = FamilyParameter.SpecType(familyParameter=flatten_3)
storageType = FamilyParameter.StorageType(familyParameter=flatten_3)
unit = FamilyParameter.Unit(familyParameter=flatten_3)
canAssignFormula = FamilyParameter.CanAssignFormula(familyParameter=flatten_3)
isReporting = FamilyParameter.IsReporting(familyParameter=flatten_3)
groupType = FamilyParameter.GroupType(familyParameter=flatten_3)
isReadOnly = FamilyParameter.IsReadOnly(familyParameter=flatten_3)
makeType = Custom[FamilyParameter.MakeType](familyParameter=flatten_3)  # package Clockwork for Dynamo 2.x; Converts an instance parameter to a type parameter. ATTENTION: Only works in a family document.
id_7 = FamilyParameter.Id(familyParameter=flatten_3)
element_by_id = ElementById(Id=id_7)
name_7 = Element.Name(element=element_by_id)
code_block_38 = CodeBlock { 1; }
add = id_7 + code_block_38
element_by_id_2 = ElementById(Id=add)
name_8 = Element.Name(element=element_by_id_2)
sharedParameterFile = Parameter.SharedParameterFile()
GUID = Custom[SharedParameterElement.GUID](sharedParameterElement=element_by_id)  # package Clockwork for Dynamo 2.x; Returns the GUID of a shared parameter
select_model_element_10 = DSModelElementSelection()  # 1 picked in the model
code_block_39 = CodeBlock { "Header Type"; }
ʳʰʸᵗʰᵐ_elements_18 = Rhythm.Revit.Elements.Elements.GetParameterValueByNameTypeOrInstance(element=select_model_element_10, parameterName=code_block_39)
select_model_element_11 = DSModelElementSelection()  # 1 picked in the model
code_block_40 = CodeBlock { "Header Type"; }
ʳʰʸᵗʰᵐ_elements_19 = Rhythm.Revit.Elements.Elements.GetParameterValueByNameTypeOrInstance(element=select_model_element_11, parameterName=code_block_40)

# group: LVL: 14"
code_block_41 = CodeBlock { "Header Type"; }
ʳʰʸᵗʰᵐ_elements_20 = Rhythm.Revit.Elements.Elements.SetParameterByNameTypeOrInstance(element=select_model_element_10, parameterName=code_block_41, value=ʳʰʸᵗʰᵐ_elements_19)
code_block_42 = CodeBlock { "LVL: 14"; }

all_family_types_of_category_3 = Custom[All Family Types Of Category]()  # unwired: category
parameters_5 = Element.Parameters(element=element_by_id)
elementType_2 = Element.ElementType(element=element_by_id)
uniqueId = Element.UniqueId(element=element_by_id)
id_8 = Element.Id(element=ʳʰʸᵗʰᵐ_elements_19)
name_9 = Element.Name(element=ʳʰʸᵗʰᵐ_elements_19)
ʳʰʸᵗʰᵐ_familyinstances = Rhythm.Revit.Elements.FamilyInstances.RetrieveNestedComponents()  # unwired: instance
family_types = FamilyTypes()  # nothing selected
select_model_element_12 = DSModelElementSelection()  # 1 picked in the model
code_block_43 = CodeBlock { "Header Type"; }
code_block_44 = CodeBlock { "2x6"; }
byName_4 = FamilyType.ByName(name=code_block_44)
watch_3 = Watch(byName_4)
setParameterByName_3 = Element.SetParameterByName(element=select_model_element_12, parameterName=code_block_43, value=watch_3)
all_elements_of_family_type = ElementsOfFamilyType()  # unwired: Family_Type
all_family_types_of_category_4 = Custom[All Family Types Of Category]()  # unwired: category
all_elements_of_family_type_2 = Custom[All Elements of Family Type+]()  # package Clockwork for Dynamo 2.x; Retrieves all placed instances of a given family type. Unlike the OOTB node, this node also supports family types of system families and collecting from linked models.; unwired: familyType
view_family_types_2 = ViewFamilyTypes("Detail")
change_family_type = Custom[Change Family Type]()  # package archi-lab.net; Changes family type of a family by passing in an Element and type id of the type we want to change it to.; unwired: element, typeId
name_10 = FamilyType.Name()  # unwired: familyType
code_block_45 = CodeBlock { "DIMENSIONAL : 2x4"; }
view_family_types_3 = ViewFamilyTypes("Building")
byFamilyAndName_2 = FamilyType.ByFamilyAndName()  # unwired: family, name
family_types_2 = FamilyTypes()  # nothing selected
types_4 = Family.Types()  # unwired: family
types_5 = FamilyDocument.Types()  # unwired: familyDocument
types_6 = Custom[Family.Types+]()  # package Clockwork for Dynamo 2.x; Returns all family types of a family. Unlike the OOTB node, it also works with families in linked documents.; unwired: family
view_family_types_4 = ViewFamilyTypes()  # nothing selected
family_types_3 = FamilyTypes()  # nothing selected
all_elements_of_family_type_3 = ElementsOfFamilyType()  # unwired: Family_Type
all_elements_of_family_type_4 = ElementsOfFamilyType()  # unwired: Family_Type
family_types_4 = FamilyTypes()  # nothing selected
setType = Custom[FamilyInstance.SetType](familyInstance=select_model_element_11, familyType=code_block_42)  # package Clockwork for Dynamo 2.x; Changes the family type of a given family instance to the specified type
setType_2 = Custom[RoomTag.SetType]()  # package Clockwork for Dynamo 2.x; Changes the family type of a given room tag to the specified type; unwired: roomTag, roomTagType
function = Custom[FamilyType.Function]()  # package Clockwork for Dynamo 2.x; Retrieves the Function property of a given family type (if it has that property); unwired: familyType
categories_4 = Categories("OST_DetailComponents")
all_placed_family_types_of = Custom[All Placed Family Types of Category](category=categories_4)  # package Clockwork for Dynamo 2.x; Retrieves all family types of a given category that have *placed* instances
name_11 = Custom[Element.Name+](element=all_placed_family_types_of)  # package Clockwork for Dynamo 2.x; Gets an element's name. Unlike the OOTB node, this node should work for *all* Revit elements that have names and will also return the localized names of system parameters, parameter groups, display unit types, parameter types, unit symbol types, unit types and ForgeTypeIds.
type_2 = archilab.Revit.Elements.WarningElement.Type()  # unwired: warningElement
typeName_2 = Custom[Element.TypeName]()  # unwired: Element
name_12 = Element.Name()  # unwired: element
family_3 = FamilyType.Family()  # unwired: familyType
byFamilyType_4 = FamilyInstance.ByFamilyType(familyType=watch_3)
family_4 = FamilyType.Family(familyType=watch_3)
select_model_element_13 = DSModelElementSelection()  # 1 picked in the model
code_block_46 = CodeBlock { 5853029; }
element_by_id_3 = ElementById(Id=code_block_46)

# group: LVL: 14"
code_block_47 = CodeBlock { "LVL: 14"; }
code_block_48 = CodeBlock { "Header Type"; }
ʳʰʸᵗʰᵐ_elements_21 = Rhythm.Revit.Elements.Elements.SetParameterByNameTypeOrInstance(element=select_model_element_13, parameterName=code_block_48, value=element_by_id_3)

ʳʰʸᵗʰᵐ_elements_22 = Rhythm.Revit.Elements.Elements.GetParameterValueByNameTypeOrInstance()  # unwired: element, parameterName

# group: Remove Mulions
string_from_object_4 = FromObject(object=members_2)
code_block_49 = CodeBlock { "Main"; }
eq_9 = string_from_object_4 == code_block_49
filterByBoolMask_19 = List.FilterByBoolMask(list=members_2, mask=eq_9)
string_from_object_5 = FromObject(object=filterByBoolMask_19.out)
code_block_50 = CodeBlock { "Secondary"; }
eq_10 = string_from_object_5 == code_block_50
filterByBoolMask_20 = List.FilterByBoolMask(list=filterByBoolMask_19.out, mask=eq_10)
list_create_3 = List.Create(item0=filterByBoolMask_20.out)

# group: Window Row
code_block_51 = CodeBlock { 1; }
flatten_4 = List.Flatten(list=list_create_3, amount=code_block_51)
getLocation = Element.GetLocation(element=list_create_3)
Z = Point.Z(point=getLocation)
flatten_5 = List.Flatten(list=Z, amount=code_block_51)
firstItem = List.FirstItem(list=Z@L2)
code_block_52 = CodeBlock { 1; }
chop = List.Chop(list=firstItem, lengths=code_block_52)
eq_11 = flatten_5@L2 == chop@L1
filterByBoolMask_21 = List.FilterByBoolMask(list=flatten_4, mask=eq_11)

getLocation_2 = Element.GetLocation()  # unwired: element
Z_2 = Point.Z(point=getLocation_2)
sortIndexByValue = List.SortIndexByValue(list=Z_2)
sort = List.Sort(list=Z_2)
indexOf = List.IndexOf(list=Z_2, element=sort)
sortByKey = List.SortByKey(keys=indexOf)  # unwired: list
getLocation_3 = Element.GetLocation(element=sortByKey.sortedList)
Z_3 = Point.Z(point=getLocation_3)
code_block_53 = CodeBlock { 2; }
flatten_6 = List.Flatten(list=filterByBoolMask_21.in@L2, amount=code_block_53)
getLocation_4 = Element.GetLocation(element=flatten_6)
count_3 = List.Count(list=getLocation_4@L2)
isEvenNumber = Custom[IsEvenNumber](val=count_3)  # package Clockwork for Dynamo 2.x; Checks if a number is even.
filterByBoolMask_22 = List.FilterByBoolMask(list=getLocation_4, mask=isEvenNumber)

# group: Window Base Line
getLocation_5 = Element.GetLocation(element=filterByBoolMask_21.in)
list_create_4 = List.Create()  # unwired: item0, item1, item2, item3
code_block_54 = CodeBlock { "Width"; }
ʳʰʸᵗʰᵐ_elements_23 = Rhythm.Revit.Elements.Elements.GetParameterValueByNameTypeOrInstance(element=filterByBoolMask_21.in, parameterName=code_block_54)
code_block_55 = CodeBlock { 2; }
div = ʳʰʸᵗʰᵐ_elements_23 / code_block_55
code_block_56 = CodeBlock { 2; }
code_block_57 = CodeBlock { 2; }
code_block_58 = CodeBlock { 1; }

# group: Get Vector
X = Point.X(point=getLocation_5)
Y = Point.Y(point=getLocation_5)
Z_4 = Point.Z(point=getLocation_5)
byCoordinates = Vector.ByCoordinates(x=X, y=Y, z=Z_4)
element_host = Custom[Element Host](element=filterByBoolMask_21.in@L2)  # package Genius Loci; Gets the host of the element. Unlike the OOTB node FamilyInstance.GetHost, it also works for elements hosted by a linked document, wall sweeps, foundations, railings and builing pads. Based on a Clockwork's node
ʳʰʸᵗʰᵐ_hostobject = Rhythm.Revit.Elements.HostObject.ExteriorSurface(hostObject=element_host)
principalDirectionsAtParameter = Surface.PrincipalDirectionsAtParameter(surface=ʳʰʸᵗʰᵐ_hostobject)
lastItem = List.LastItem(list=principalDirectionsAtParameter)
tangentAtVParameter = Surface.TangentAtVParameter(surface=ʳʰʸᵗʰᵐ_hostobject)

# group (continued): Window Base Line
reverse = Vector.Reverse(vector=tangentAtVParameter)
byStartPointDirectionLength = Line.ByStartPointDirectionLength(startPoint=getLocation_5, direction=reverse, length=div)
flatten_7 = List.Flatten(list=byStartPointDirectionLength@L4, amount=code_block_56)
startPoint = Curve.StartPoint(curve=flatten_7)
endPoint = Curve.EndPoint(curve=flatten_7)
byStartPointDirectionLength_2 = Line.ByStartPointDirectionLength(startPoint=getLocation_5, direction=tangentAtVParameter, length=div)
flatten_8 = List.Flatten(list=byStartPointDirectionLength_2@L4, amount=code_block_57)
endPoint_2 = Curve.EndPoint(curve=flatten_8)
startPoint_2 = Curve.StartPoint(curve=flatten_8)
combine = List.Combine(combineFunction=list_create_4, list0=startPoint, list1=endPoint, list2=endPoint_2, list3=startPoint_2)
flatten_9 = List.Flatten(list=combine@L3, amount=code_block_58)
byBestFitThroughPoints = Line.ByBestFitThroughPoints(bestFitPoints=flatten_9)

length_3 = Curve.Length(curve=byBestFitThroughPoints)
