# Dynamo graph Auto Header V 1.26.dyn (Dynamo 2.16.2.5624)
# author: Yousef Altear
# Auo Paradigm Header
# packages: Clockwork for Dynamo 2.x 2.6.0, Rhythm 2023.9.1, Genius Loci 2023.7.13, archi-lab.net 2024.217.1024

# group: Auto Paradigm Header
# note: Ⓒ Copyright of Script to Paragons Egypt Team

# group: Multiple Window
all_elements_in_active_view = ElementsInView()
string_from_object = FromObject(object=all_elements_in_active_view)
code_block = CodeBlock { "AssemblyInstance"; }
eq = string_from_object == code_block
filterByBoolMask = List.FilterByBoolMask(list=all_elements_in_active_view, mask=eq)
members = Custom[Assembly.Members](assembly=filterByBoolMask.in)  # package Clockwork for Dynamo 2.x; Retrieves the members of an assembly
string_from_object_2 = FromObject(object=members)
code_block_2 = CodeBlock { "Main"; }
code_block_3 = CodeBlock { "Secondary"; }
list_create = List.Create(item0=code_block_2, item1=code_block_3)
eq_2 = string_from_object_2 == list_create  # lacing=CrossProduct
anyTrue = Custom[Booleans.AnyTrue](seq=eq_2)  # package Clockwork for Dynamo 2.x; Returns true if any item in a list of booleans is true. ATTENTION: This node will be deprecated in 2024. As of Revit 2022, please switch to the OOTB node AnyTrue.
anyTrue_2 = List.AnyTrue(list=anyTrue@L2)
filterByBoolMask_2 = List.FilterByBoolMask(list=filterByBoolMask.in, mask=anyTrue_2)
members_2 = Custom[Assembly.Members](assembly=filterByBoolMask_2.in)

# group: Single Windows
categories = Categories("OST_Windows")
all_family_types_of_category = Custom[All Family Types Of Category](category=categories)  # package Clockwork for Dynamo 2.x; Gets all family types/symbols of a given category in the model.
byFamilyType = FamilyInstance.ByFamilyType(familyType=all_family_types_of_category)
flatten = List.Flatten(list=byFamilyType)
id = Element.Id(element=members_2)
flatten_2 = List.Flatten(list=id)
count = List.Count(list=flatten_2)

# group: Interior Window
element_host = Custom[Element Host](element=flatten)  # package Genius Loci; Gets the host of the element. Unlike the OOTB node FamilyInstance.GetHost, it also works for elements hosted by a linked document, wall sweeps, foundations, railings and builing pads. Based on a Clockwork's node
code_block_4 = CodeBlock { "Function"; }
ʳʰʸᵗʰᵐ_elements = Rhythm.Revit.Elements.Elements.GetParameterValueByNameTypeOrInstance(element=element_host, parameterName=code_block_4)
code_block_5 = CodeBlock { 0; "INTERIOR WALL"; }
eq_3 = ʳʰʸᵗʰᵐ_elements == code_block_5.out0
code_block_6 = CodeBlock { "Wall Type"; }
ʳʰʸᵗʰᵐ_elements_2 = Rhythm.Revit.Elements.Elements.GetParameterValueByNameTypeOrInstance(element=element_host, parameterName=code_block_6)
eq_4 = ʳʰʸᵗʰᵐ_elements_2 == code_block_5.out1
and_ = And(bool0=eq_3, bool1=eq_4)
filterByBoolMask_3 = List.FilterByBoolMask(list=flatten, mask=and_)

# group (continued): Single Windows
id_2 = Element.Id(element=filterByBoolMask_3.out)
eq_5 = id_2 == flatten_2  # lacing=CrossProduct
anyTrue_3 = List.AnyTrue(list=eq_5@L2)
filterByBoolMask_4 = List.FilterByBoolMask(list=filterByBoolMask_3.out, mask=anyTrue_3)
count_2 = List.Count(list=filterByBoolMask_4.in)

# group: Headeer Count
code_block_7 = CodeBlock { "Header Count"; }
code_block_8 = CodeBlock { 2; }
ʳʰʸᵗʰᵐ_elements_3 = Rhythm.Revit.Elements.Elements.SetParameterByNameTypeOrInstance(element=filterByBoolMask_4.out, parameterName=code_block_7, value=code_block_8)

# group: Match Type
code_block_9 = CodeBlock { "Width"; }
ʳʰʸᵗʰᵐ_elements_4 = Rhythm.Revit.Elements.Elements.GetParameterValueByNameTypeOrInstance(element=filterByBoolMask_4.out, parameterName=code_block_9)

# group: Dimentional 2X10 Filter
code_block_10 = CodeBlock(x=ʳʰʸᵗʰᵐ_elements_4) { x<=5.5; }
filterByBoolMask_5 = List.FilterByBoolMask(list=filterByBoolMask_4.out, mask=code_block_10)
filterByBoolMask_6 = List.FilterByBoolMask(list=ʳʰʸᵗʰᵐ_elements_4, mask=code_block_10)

# group: Dimentional 2X10
code_block_11 = CodeBlock { "DIMENSIONAL : 2x10"; }
code_block_12 = CodeBlock { "Header Type"; }
ʳʰʸᵗʰᵐ_elements_5 = Rhythm.Revit.Elements.Elements.SetParameterByNameTypeOrInstance(element=filterByBoolMask_5.in, parameterName=code_block_12)  # unwired: value

# group: LVL: 9-1/4"
code_block_13 = CodeBlock(x=filterByBoolMask_6.out) { x<=9.5; }
filterByBoolMask_7 = List.FilterByBoolMask(list=filterByBoolMask_5.out, mask=code_block_13)
filterByBoolMask_8 = List.FilterByBoolMask(list=filterByBoolMask_6.out, mask=code_block_13)

# group: LVL: 9-1/4"
code_block_14 = CodeBlock { "Header Type"; }
code_block_15 = CodeBlock { "LVL: 9-1/4"; }
ʳʰʸᵗʰᵐ_elements_6 = Rhythm.Revit.Elements.Elements.SetParameterByNameTypeOrInstance(element=filterByBoolMask_7.in, parameterName=code_block_14, value=code_block_15)

# group: LVL: 11-7/8" Filter
code_block_16 = CodeBlock(x=filterByBoolMask_8.out) { x<=15.5; }
filterByBoolMask_9 = List.FilterByBoolMask(list=filterByBoolMask_7.out, mask=code_block_16)
filterByBoolMask_10 = List.FilterByBoolMask(list=filterByBoolMask_8.out, mask=code_block_16)

code_block_17 = CodeBlock { "Header Type"; }

# group: LVL: 11-7/8"
code_block_18 = CodeBlock { "LVL: 11-7/8"; }
ʳʰʸᵗʰᵐ_elements_7 = Rhythm.Revit.Elements.Elements.SetParameterByNameTypeOrInstance(element=filterByBoolMask_9.in, parameterName=code_block_17, value=code_block_18)

# group: LVL: 14" Filter
code_block_19 = CodeBlock(x=filterByBoolMask_10.out) { x<=17.5; }
filterByBoolMask_11 = List.FilterByBoolMask(list=filterByBoolMask_9.out, mask=code_block_19)
filterByBoolMask_12 = List.FilterByBoolMask(list=filterByBoolMask_10.out, mask=code_block_19)

# group: LVL: 14"
code_block_20 = CodeBlock { "Header Type"; }
code_block_21 = CodeBlock { "LVL: 14"; }
ʳʰʸᵗʰᵐ_elements_8 = Rhythm.Revit.Elements.Elements.SetParameterByNameTypeOrInstance(element=filterByBoolMask_11.in, parameterName=code_block_20, value=code_block_21)

# group: LVL:16" Filter
code_block_22 = CodeBlock(x=filterByBoolMask_12.out) { x>17.6; }
filterByBoolMask_13 = List.FilterByBoolMask(list=filterByBoolMask_11.out, mask=code_block_22)
filterByBoolMask_14 = List.FilterByBoolMask(list=filterByBoolMask_10.out, mask=code_block_22)

code_block_23 = CodeBlock { "Header Type"; }

# group: LVL:16"
code_block_24 = CodeBlock { "LVL:16"; }
ʳʰʸᵗʰᵐ_elements_9 = Rhythm.Revit.Elements.Elements.SetParameterByNameTypeOrInstance(element=filterByBoolMask_13.in, parameterName=code_block_23, value=code_block_24)

# group: Remove Mulions
string_from_object_3 = FromObject(object=members_2)
code_block_25 = CodeBlock { "Main"; }
eq_6 = string_from_object_3 == code_block_25
filterByBoolMask_15 = List.FilterByBoolMask(list=members_2, mask=eq_6)
string_from_object_4 = FromObject(object=filterByBoolMask_15.out)
code_block_26 = CodeBlock { "Secondary"; }
eq_7 = string_from_object_4 == code_block_26
filterByBoolMask_16 = List.FilterByBoolMask(list=filterByBoolMask_15.out, mask=eq_7)
list_create_2 = List.Create(item0=filterByBoolMask_16.out)

# group: Window Row
code_block_27 = CodeBlock { 1; }
flatten_3 = List.Flatten(list=list_create_2, amount=code_block_27)
getLocation = Element.GetLocation(element=list_create_2)
Z = Point.Z(point=getLocation)
flatten_4 = List.Flatten(list=Z, amount=code_block_27)
firstItem = List.FirstItem(list=Z@L2)
code_block_28 = CodeBlock { 1; }
chop = List.Chop(list=firstItem, lengths=code_block_28)
eq_8 = flatten_4@L2 == chop@L1
filterByBoolMask_17 = List.FilterByBoolMask(list=flatten_3, mask=eq_8)

# group: Get middle window
code_block_29 = CodeBlock { 2; }
flatten_5 = List.Flatten(list=filterByBoolMask_17.in@L2, amount=code_block_29)
count_3 = List.Count(list=flatten_5@L2)
code_block_30 = CodeBlock { 1; }
chop_2 = List.Chop(list=count_3, lengths=code_block_30)
code_block_31 = CodeBlock { 2; }
div = chop_2@L2 / code_block_31
ceiling = Math.Ceiling(number=div)
code_block_32 = CodeBlock { 1; }
sub = ceiling - code_block_32
getItemAtIndex = List.GetItemAtIndex(list=flatten_5@L2, index=sub@L2)
flatten_6 = List.Flatten(list=flatten_5)
id_3 = Element.Id(element=flatten_6)

flatten_7 = List.Flatten(list=getItemAtIndex)

# group: Headeer Count
code_block_33 = CodeBlock { "Header Count"; }
code_block_34 = CodeBlock { 2; }
ʳʰʸᵗʰᵐ_elements_10 = Rhythm.Revit.Elements.Elements.SetParameterByNameTypeOrInstance(element=flatten_7, parameterName=code_block_33, value=code_block_34)

# group (continued): Get middle window
id_4 = Element.Id(element=flatten_7)
eq_9 = id_3@L1 == id_4
anyTrue_4 = List.AnyTrue(list=eq_9@L2)
filterByBoolMask_18 = List.FilterByBoolMask(list=flatten_6, mask=anyTrue_4)

# group: Headeer Count
code_block_35 = CodeBlock { "Header Count"; }
code_block_36 = CodeBlock { 0; }
ʳʰʸᵗʰᵐ_elements_11 = Rhythm.Revit.Elements.Elements.SetParameterByNameTypeOrInstance(element=filterByBoolMask_18.out, parameterName=code_block_35, value=code_block_36)

# group: None
code_block_37 = CodeBlock { "DIMENSIONAL : 2x10"; }
code_block_38 = CodeBlock { "Header Type"; }
ʳʰʸᵗʰᵐ_elements_12 = Rhythm.Revit.Elements.Elements.SetParameterByNameTypeOrInstance(element=filterByBoolMask_18.out, parameterName=code_block_38)  # unwired: value

# group: Single door
categories_2 = Categories("OST_Doors")
all_family_types_of_category_2 = Custom[All Family Types Of Category](category=categories_2)
byFamilyType_2 = FamilyInstance.ByFamilyType(familyType=all_family_types_of_category_2)
flatten_8 = List.Flatten(list=byFamilyType_2)
code_block_39 = CodeBlock { "Function"; }
ʳʰʸᵗʰᵐ_elements_13 = Rhythm.Revit.Elements.Elements.GetParameterValueByNameTypeOrInstance(element=flatten_8, parameterName=code_block_39)
code_block_40 = CodeBlock { 0; }
eq_10 = ʳʰʸᵗʰᵐ_elements_13 == code_block_40
filterByBoolMask_19 = List.FilterByBoolMask(list=flatten_8, mask=eq_10)

# group: Bearing wall detect
element_host_2 = Custom[Element Host](element=filterByBoolMask_19.in)
code_block_41 = CodeBlock { "Wall Type"; }
ʳʰʸᵗʰᵐ_elements_14 = Rhythm.Revit.Elements.Elements.GetParameterValueByNameTypeOrInstance(element=element_host_2, parameterName=code_block_41)
code_block_42 = CodeBlock { "BEARING WALL"; }
eq_11 = ʳʰʸᵗʰᵐ_elements_14 == code_block_42
filterByBoolMask_20 = List.FilterByBoolMask(list=filterByBoolMask_19.in, mask=eq_11)
list_create_3 = List.Create(item0=filterByBoolMask_3.in, item1=filterByBoolMask_20.out)
flatten_9 = List.Flatten(list=list_create_3)

# group: Match Type
code_block_43 = CodeBlock { "Width"; }
ʳʰʸᵗʰᵐ_elements_15 = Rhythm.Revit.Elements.Elements.GetParameterValueByNameTypeOrInstance(element=flatten_9, parameterName=code_block_43)

# group: Dimentional 2X10 Filter
code_block_44 = CodeBlock(x=ʳʰʸᵗʰᵐ_elements_15) { x<=5.5; }
filterByBoolMask_21 = List.FilterByBoolMask(list=flatten_9, mask=code_block_44)
filterByBoolMask_22 = List.FilterByBoolMask(list=ʳʰʸᵗʰᵐ_elements_15, mask=code_block_44)

# group: LVL: 9-1/4"
code_block_45 = CodeBlock(x=filterByBoolMask_22.out) { x<=9.5; }
filterByBoolMask_23 = List.FilterByBoolMask(list=filterByBoolMask_21.out, mask=code_block_45)
filterByBoolMask_24 = List.FilterByBoolMask(list=filterByBoolMask_22.out, mask=code_block_45)

# group: LVL: 11-7/8" Filter
code_block_46 = CodeBlock(x=filterByBoolMask_24.out) { x<=15.5; }
filterByBoolMask_25 = List.FilterByBoolMask(list=filterByBoolMask_23.out, mask=code_block_46)
filterByBoolMask_26 = List.FilterByBoolMask(list=filterByBoolMask_24.out, mask=code_block_46)

# group: LVL: 14" Filter
code_block_47 = CodeBlock(x=filterByBoolMask_26.out) { x<=17.5; }
filterByBoolMask_27 = List.FilterByBoolMask(list=filterByBoolMask_25.out, mask=code_block_47)
filterByBoolMask_28 = List.FilterByBoolMask(list=filterByBoolMask_26.out, mask=code_block_47)

# group: LVL:16" Filter
code_block_48 = CodeBlock(x=filterByBoolMask_28.out) { x>17.6; }
filterByBoolMask_29 = List.FilterByBoolMask(list=filterByBoolMask_27.out, mask=code_block_48)
filterByBoolMask_30 = List.FilterByBoolMask(list=filterByBoolMask_26.out, mask=code_block_48)

# group: If Case
if_ = RefactoredIf()  # unwired: test, true, false

# group: LVL:16"
code_block_49 = CodeBlock { "Header Type"; }
ʳʰʸᵗʰᵐ_elements_16 = Rhythm.Revit.Elements.Elements.SetParameterByNameTypeOrInstance(element=filterByBoolMask_29.in, parameterName=code_block_49, value=if_)

# group: If Case
if_2 = RefactoredIf()  # unwired: test, true, false

# group: LVL: 14"
code_block_50 = CodeBlock { "Header Type"; }
ʳʰʸᵗʰᵐ_elements_17 = Rhythm.Revit.Elements.Elements.SetParameterByNameTypeOrInstance(element=filterByBoolMask_27.in, parameterName=code_block_50, value=if_2)

# group: If Case
if_3 = RefactoredIf()  # unwired: test, true, false

# group: LVL: 11-7/8"
code_block_51 = CodeBlock { "Header Type"; }
ʳʰʸᵗʰᵐ_elements_18 = Rhythm.Revit.Elements.Elements.SetParameterByNameTypeOrInstance(element=filterByBoolMask_25.in, parameterName=code_block_51, value=if_3)

# group: If Case
if_4 = RefactoredIf()  # unwired: test, true, false

# group: LVL: 9-1/4"
code_block_52 = CodeBlock { "Header Type"; }
ʳʰʸᵗʰᵐ_elements_19 = Rhythm.Revit.Elements.Elements.SetParameterByNameTypeOrInstance(element=filterByBoolMask_23.in, parameterName=code_block_52, value=if_4)

# group: If Case
if_5 = RefactoredIf()  # unwired: test, true, false

# group: Dimentional 2X10
code_block_53 = CodeBlock { "Header Type"; }
ʳʰʸᵗʰᵐ_elements_20 = Rhythm.Revit.Elements.Elements.SetParameterByNameTypeOrInstance(element=filterByBoolMask_21.in, parameterName=code_block_53, value=if_5)

# group: Non Bearing Header _No paradigm Defult_Count
code_block_54 = CodeBlock { "Header Count"; }
ʳʰʸᵗʰᵐ_elements_21 = Rhythm.Revit.Elements.Elements.GetParameterValueByNameTypeOrInstance(element=flatten_9, parameterName=code_block_54)

# group: If Case
non_bearing_header = BoolSelector(false)  # graph input
use_paradigm_defult_for_interior = BoolSelector(false)  # "Use Paradigm Defult (for Interior Doors)"; graph input
and_2 = And(bool0=non_bearing_header, bool1=use_paradigm_defult_for_interior)
code_block_55 = CodeBlock { 2; }
or_ = Or(bool0=non_bearing_header, bool1=use_paradigm_defult_for_interior)
code_block_56 = CodeBlock { 0; }
if_6 = RefactoredIf(test=or_, true=ʳʰʸᵗʰᵐ_elements_21, false=code_block_56)
if_7 = RefactoredIf(test=and_2, true=code_block_55, false=if_6)

# group: Headeer Count
code_block_57 = CodeBlock { "Header Count"; }
ʳʰʸᵗʰᵐ_elements_22 = Rhythm.Revit.Elements.Elements.SetParameterByNameTypeOrInstance(element=flatten_9, parameterName=code_block_57, value=if_7)

# group: Garage Filter
flatten_10 = List.Flatten(list=filterByBoolMask_19.out)
code_block_58 = CodeBlock { "Family"; }
ʳʰʸᵗʰᵐ_elements_23 = Rhythm.Revit.Elements.Elements.GetParameterValueByNameTypeOrInstance(element=flatten_10, parameterName=code_block_58)
string_from_object_5 = FromObject(object=ʳʰʸᵗʰᵐ_elements_23)
code_block_59 = CodeBlock { "GarageDoor"; }
contains = String.Contains(string=string_from_object_5, searchFor=code_block_59)
filterByBoolMask_31 = List.FilterByBoolMask(list=flatten_10, mask=contains)
list_create_4 = List.Create(item0=filterByBoolMask_20.in, item1=filterByBoolMask_31.out)
flatten_11 = List.Flatten(list=list_create_4)

# group: Family Data
type = archilab.Revit.Elements.Elements.Type(element=flatten_10)
parameters = Element.Parameters(element=type)
watch = Watch(parameters)
parameters_2 = Element.Parameters(element=flatten_10)
watch_2 = Watch(parameters_2)

# group: Match Type
code_block_60 = CodeBlock { "Width"; }
ʳʰʸᵗʰᵐ_elements_24 = Rhythm.Revit.Elements.Elements.GetParameterValueByNameTypeOrInstance(element=flatten_11, parameterName=code_block_60)

# group: Dimentional 2X10 Filter
code_block_61 = CodeBlock(x=ʳʰʸᵗʰᵐ_elements_24) { x<=5.5; }
filterByBoolMask_32 = List.FilterByBoolMask(list=flatten_11, mask=code_block_61)
filterByBoolMask_33 = List.FilterByBoolMask(list=ʳʰʸᵗʰᵐ_elements_24, mask=code_block_61)

# group: LVL: 9-1/4"
code_block_62 = CodeBlock(x=filterByBoolMask_33.out) { x<=9.5; }
filterByBoolMask_34 = List.FilterByBoolMask(list=filterByBoolMask_32.out, mask=code_block_62)
filterByBoolMask_35 = List.FilterByBoolMask(list=filterByBoolMask_33.out, mask=code_block_62)

# group: LVL: 9-1/4"
code_block_63 = CodeBlock { "Header Type"; }
code_block_64 = CodeBlock { "LVL: 9-1/4"; }
ʳʰʸᵗʰᵐ_elements_25 = Rhythm.Revit.Elements.Elements.SetParameterByNameTypeOrInstance(element=filterByBoolMask_34.in, parameterName=code_block_63, value=code_block_64)

# group: LVL: 11-7/8" Filter
code_block_65 = CodeBlock(x=filterByBoolMask_35.out) { x<=15.5; }
filterByBoolMask_36 = List.FilterByBoolMask(list=filterByBoolMask_34.out, mask=code_block_65)
filterByBoolMask_37 = List.FilterByBoolMask(list=filterByBoolMask_35.out, mask=code_block_65)

# group: LVL: 11-7/8"
code_block_66 = CodeBlock { "Header Type"; }
code_block_67 = CodeBlock { "LVL: 11-7/8"; }
ʳʰʸᵗʰᵐ_elements_26 = Rhythm.Revit.Elements.Elements.SetParameterByNameTypeOrInstance(element=filterByBoolMask_36.in, parameterName=code_block_66, value=code_block_67)

# group: LVL: 14" Filter
code_block_68 = CodeBlock(x=filterByBoolMask_37.out) { x<=17.5; }
filterByBoolMask_38 = List.FilterByBoolMask(list=filterByBoolMask_36.out, mask=code_block_68)
filterByBoolMask_39 = List.FilterByBoolMask(list=filterByBoolMask_37.out, mask=code_block_68)

# group: LVL: 14"
code_block_69 = CodeBlock { "Header Type"; }
code_block_70 = CodeBlock { "LVL: 14"; }
ʳʰʸᵗʰᵐ_elements_27 = Rhythm.Revit.Elements.Elements.SetParameterByNameTypeOrInstance(element=filterByBoolMask_38.in, parameterName=code_block_69, value=code_block_70)

# group: LVL:16" Filter
code_block_71 = CodeBlock(x=filterByBoolMask_39.out) { x>17.6; }
filterByBoolMask_40 = List.FilterByBoolMask(list=filterByBoolMask_38.out, mask=code_block_71)
filterByBoolMask_41 = List.FilterByBoolMask(list=filterByBoolMask_37.out, mask=code_block_71)

code_block_72 = CodeBlock { "Header Type"; }

# group: LVL:16"
code_block_73 = CodeBlock { "LVL:16"; }
ʳʰʸᵗʰᵐ_elements_28 = Rhythm.Revit.Elements.Elements.SetParameterByNameTypeOrInstance(element=filterByBoolMask_40.in, parameterName=code_block_72, value=code_block_73)

# group: Dimentional 2X10
code_block_74 = CodeBlock { "Header Type"; }
ʳʰʸᵗʰᵐ_elements_29 = Rhythm.Revit.Elements.Elements.SetParameterByNameTypeOrInstance(element=filterByBoolMask_32.in, parameterName=code_block_74)  # unwired: value
code_block_75 = CodeBlock { "DIMENSIONAL : 2x10"; }

# group: Headeer Count
code_block_76 = CodeBlock { "Header Count"; }
code_block_77 = CodeBlock { 2; }
ʳʰʸᵗʰᵐ_elements_30 = Rhythm.Revit.Elements.Elements.SetParameterByNameTypeOrInstance(element=flatten_11, parameterName=code_block_76, value=code_block_77)

# group: Headeer Count
code_block_78 = CodeBlock { "Header Count"; }
code_block_79 = CodeBlock { 2; }
ʳʰʸᵗʰᵐ_elements_31 = Rhythm.Revit.Elements.Elements.SetParameterByNameTypeOrInstance(element=filterByBoolMask_31.in, parameterName=code_block_78, value=code_block_79)

# group: Match Type
code_block_80 = CodeBlock { "Width"; }
ʳʰʸᵗʰᵐ_elements_32 = Rhythm.Revit.Elements.Elements.GetParameterValueByNameTypeOrInstance(element=filterByBoolMask_31.in, parameterName=code_block_80)

# group: LVL: 11-7/8" Filter
code_block_81 = CodeBlock(x=ʳʰʸᵗʰᵐ_elements_32) { x<=16; }
filterByBoolMask_42 = List.FilterByBoolMask(list=ʳʰʸᵗʰᵐ_elements_32, mask=code_block_81)
filterByBoolMask_43 = List.FilterByBoolMask(list=filterByBoolMask_31.in, mask=code_block_81)

# group: LVL: 14" Filter
code_block_82 = CodeBlock(x=filterByBoolMask_42.out) { x<=18; }
filterByBoolMask_44 = List.FilterByBoolMask(list=filterByBoolMask_42.out, mask=code_block_82)
filterByBoolMask_45 = List.FilterByBoolMask(list=filterByBoolMask_43.out, mask=code_block_82)

# group: LVL:16" Filter
code_block_83 = CodeBlock(x=filterByBoolMask_44.out) { x>20; }
filterByBoolMask_46 = List.FilterByBoolMask(list=filterByBoolMask_42.out, mask=code_block_83)
filterByBoolMask_47 = List.FilterByBoolMask(list=filterByBoolMask_45.out, mask=code_block_83)

code_block_84 = CodeBlock { "Header Type"; }

# group: LVL:16"
code_block_85 = CodeBlock { "LVL:16"; }
ʳʰʸᵗʰᵐ_elements_33 = Rhythm.Revit.Elements.Elements.SetParameterByNameTypeOrInstance(element=filterByBoolMask_47.in, parameterName=code_block_84, value=code_block_85)

# group: LVL: 14"
code_block_86 = CodeBlock { "Header Type"; }
code_block_87 = CodeBlock { "LVL: 14"; }
ʳʰʸᵗʰᵐ_elements_34 = Rhythm.Revit.Elements.Elements.SetParameterByNameTypeOrInstance(element=filterByBoolMask_45.in, parameterName=code_block_86, value=code_block_87)

# group: LVL: 11-7/8"
code_block_88 = CodeBlock { "Header Type"; }
code_block_89 = CodeBlock { "LVL: 11-7/8"; }
ʳʰʸᵗʰᵐ_elements_35 = Rhythm.Revit.Elements.Elements.SetParameterByNameTypeOrInstance(element=filterByBoolMask_43.in, parameterName=code_block_88, value=code_block_89)

# group: Non Bearing Header _No paradigm Defult_Type
code_block_90 = CodeBlock { "Header Type"; }
ʳʰʸᵗʰᵐ_elements_36 = Rhythm.Revit.Elements.Elements.GetParameterValueByNameTypeOrInstance(element=filterByBoolMask_21.in, parameterName=code_block_90)

# group: Non Bearing Header _No paradigm Defult_Type
code_block_91 = CodeBlock { "Header Type"; }
ʳʰʸᵗʰᵐ_elements_37 = Rhythm.Revit.Elements.Elements.GetParameterValueByNameTypeOrInstance(element=filterByBoolMask_23.in, parameterName=code_block_91)

# group: Non Bearing Header _No paradigm Defult_Type
code_block_92 = CodeBlock { "Header Type"; }
ʳʰʸᵗʰᵐ_elements_38 = Rhythm.Revit.Elements.Elements.GetParameterValueByNameTypeOrInstance(element=filterByBoolMask_25.in, parameterName=code_block_92)

# group: Non Bearing Header _No paradigm Defult_Type
code_block_93 = CodeBlock { "Header Type"; }
ʳʰʸᵗʰᵐ_elements_39 = Rhythm.Revit.Elements.Elements.GetParameterValueByNameTypeOrInstance(element=filterByBoolMask_27.in, parameterName=code_block_93)

# group: Non Bearing Header _No paradigm Defult_Type
code_block_94 = CodeBlock { "Header Type"; }
ʳʰʸᵗʰᵐ_elements_40 = Rhythm.Revit.Elements.Elements.GetParameterValueByNameTypeOrInstance(element=filterByBoolMask_29.in, parameterName=code_block_94)

# group: Window Base Line
getLocation_2 = Element.GetLocation(element=filterByBoolMask_17.in)
list_create_5 = List.Create()  # unwired: item0, item1, item2, item3
code_block_95 = CodeBlock { "Width"; }
ʳʰʸᵗʰᵐ_elements_41 = Rhythm.Revit.Elements.Elements.GetParameterValueByNameTypeOrInstance(element=filterByBoolMask_17.in, parameterName=code_block_95)
code_block_96 = CodeBlock { 2; }
div_2 = ʳʰʸᵗʰᵐ_elements_41 / code_block_96
code_block_97 = CodeBlock { 2; }
code_block_98 = CodeBlock { 2; }
code_block_99 = CodeBlock { 1; }

# group: Get Vector
X = Point.X(point=getLocation_2)
Y = Point.Y(point=getLocation_2)
Z_2 = Point.Z(point=getLocation_2)
byCoordinates = Vector.ByCoordinates(x=X, y=Y, z=Z_2)
element_host_3 = Custom[Element Host](element=filterByBoolMask_17.in@L2)
ʳʰʸᵗʰᵐ_hostobject = Rhythm.Revit.Elements.HostObject.ExteriorSurface(hostObject=element_host_3)
principalDirectionsAtParameter = Surface.PrincipalDirectionsAtParameter(surface=ʳʰʸᵗʰᵐ_hostobject)
lastItem = List.LastItem(list=principalDirectionsAtParameter)
tangentAtVParameter = Surface.TangentAtVParameter(surface=ʳʰʸᵗʰᵐ_hostobject)

# group (continued): Window Base Line
reverse = Vector.Reverse(vector=tangentAtVParameter)
byStartPointDirectionLength = Line.ByStartPointDirectionLength(startPoint=getLocation_2, direction=reverse, length=div_2)
flatten_12 = List.Flatten(list=byStartPointDirectionLength@L4, amount=code_block_97)
startPoint = Curve.StartPoint(curve=flatten_12)
endPoint = Curve.EndPoint(curve=flatten_12)
byStartPointDirectionLength_2 = Line.ByStartPointDirectionLength(startPoint=getLocation_2, direction=tangentAtVParameter, length=div_2)
flatten_13 = List.Flatten(list=byStartPointDirectionLength_2@L4, amount=code_block_98)
endPoint_2 = Curve.EndPoint(curve=flatten_13)
startPoint_2 = Curve.StartPoint(curve=flatten_13)
combine = List.Combine(combineFunction=list_create_5, list0=startPoint, list1=endPoint, list2=endPoint_2, list3=startPoint_2)
flatten_14 = List.Flatten(list=combine@L3, amount=code_block_99)
byBestFitThroughPoints = Line.ByBestFitThroughPoints(bestFitPoints=flatten_14)

# group: Width
length = Curve.Length(curve=byBestFitThroughPoints)
code_block_100 = CodeBlock { "Width"; }

# group: Dimentional 2X10 Filter
code_block_101 = CodeBlock(x=length) { x<=5.5; }
filterByBoolMask_48 = List.FilterByBoolMask(list=length, mask=code_block_101)
filterByBoolMask_49 = List.FilterByBoolMask(list=flatten_7, mask=code_block_101)

# group: LVL: 9-1/4"
code_block_102 = CodeBlock(x=filterByBoolMask_48.out) { x<=9.5; }
filterByBoolMask_50 = List.FilterByBoolMask(list=filterByBoolMask_48.out, mask=code_block_102)
filterByBoolMask_51 = List.FilterByBoolMask(list=filterByBoolMask_49.out, mask=code_block_102)

# group: LVL: 11-7/8" Filter
code_block_103 = CodeBlock(x=filterByBoolMask_50.out) { x<=15.5; }
filterByBoolMask_52 = List.FilterByBoolMask(list=filterByBoolMask_50.out, mask=code_block_103)
filterByBoolMask_53 = List.FilterByBoolMask(list=filterByBoolMask_51.out, mask=code_block_103)

# group: LVL: 14" Filter
code_block_104 = CodeBlock(x=filterByBoolMask_52.out) { x<=17.5; }
filterByBoolMask_54 = List.FilterByBoolMask(list=filterByBoolMask_52.out, mask=code_block_104)
filterByBoolMask_55 = List.FilterByBoolMask(list=filterByBoolMask_53.out, mask=code_block_104)

# group: LVL:16" Filter
code_block_105 = CodeBlock(x=filterByBoolMask_54.out) { x>17.6; }
filterByBoolMask_56 = List.FilterByBoolMask(list=filterByBoolMask_52.out, mask=code_block_105)
filterByBoolMask_57 = List.FilterByBoolMask(list=filterByBoolMask_55.out, mask=code_block_105)

# group: LVL:16"
code_block_106 = CodeBlock { "Header Type"; }
code_block_107 = CodeBlock { "LVL:16"; }
ʳʰʸᵗʰᵐ_elements_42 = Rhythm.Revit.Elements.Elements.SetParameterByNameTypeOrInstance(element=filterByBoolMask_57.in, parameterName=code_block_106, value=code_block_107)

# group: LVL: 14"
code_block_108 = CodeBlock { "Header Type"; }
code_block_109 = CodeBlock { "LVL: 14"; }
ʳʰʸᵗʰᵐ_elements_43 = Rhythm.Revit.Elements.Elements.SetParameterByNameTypeOrInstance(element=filterByBoolMask_55.in, parameterName=code_block_108, value=code_block_109)

# group: LVL: 11-7/8"
code_block_110 = CodeBlock { "Header Type"; }
code_block_111 = CodeBlock { "LVL: 11-7/8"; }
ʳʰʸᵗʰᵐ_elements_44 = Rhythm.Revit.Elements.Elements.SetParameterByNameTypeOrInstance(element=filterByBoolMask_53.in, parameterName=code_block_110, value=code_block_111)

# group: LVL: 9-1/4"
code_block_112 = CodeBlock { "Header Type"; }
code_block_113 = CodeBlock { "LVL: 9-1/4"; }
ʳʰʸᵗʰᵐ_elements_45 = Rhythm.Revit.Elements.Elements.SetParameterByNameTypeOrInstance(element=filterByBoolMask_51.in, parameterName=code_block_112, value=code_block_113)

# group: Dimentional 2X10
code_block_114 = CodeBlock { "Header Type"; }
ʳʰʸᵗʰᵐ_elements_46 = Rhythm.Revit.Elements.Elements.SetParameterByNameTypeOrInstance(element=filterByBoolMask_49.in, parameterName=code_block_114)  # unwired: value
code_block_115 = CodeBlock { "DIMENSIONAL : 2x10"; }
