# Dynamo graph Auto Header V 1.28.dyn "Auto Header V 1.27" (Dynamo 2.16.2.5624)
# author: Yousef Altear
# Auo Paradigm Header
# packages: Clockwork for Dynamo 2.x 2.6.0, Rhythm 2023.9.1, Genius Loci 2023.7.13, archi-lab.net 2024.217.1024

# group: Auto Paradigm Header
# note: Ⓒ Copyright of Script to Paragons Egypt Team

# group: Multiple Window
all_elements_in_active_view = ElementsInView()
string_from_object = FromObject(object=all_elements_in_active_view)
code_block = CodeBlock { "AssemblyInstance"; }
eq = string_from_object == code_block
filterByBoolMask = List.FilterByBoolMask(list=all_elements_in_active_view, mask=eq)
members = Custom[Assembly.Members](assembly=filterByBoolMask.in)  # package Clockwork for Dynamo 2.x; Retrieves the members of an assembly
string_from_object_2 = FromObject(object=members)
code_block_2 = CodeBlock { "Main"; }
code_block_3 = CodeBlock { "Secondary"; }
list_create = List.Create(item0=code_block_2, item1=code_block_3)
eq_2 = string_from_object_2 == list_create  # lacing=CrossProduct
anyTrue = Custom[Booleans.AnyTrue](seq=eq_2)  # package Clockwork for Dynamo 2.x; Returns true if any item in a list of booleans is true. ATTENTION: This node will be deprecated in 2024. As of Revit 2022, please switch to the OOTB node AnyTrue.
anyTrue_2 = List.AnyTrue(list=anyTrue@L2)
filterByBoolMask_2 = List.FilterByBoolMask(list=filterByBoolMask.in, mask=anyTrue_2)
members_2 = Custom[Assembly.Members](assembly=filterByBoolMask_2.in)
members_3 = Custom[Assembly.Members](assembly=filterByBoolMask_2.out)

# group: Window Row
code_block_4 = CodeBlock { 1; }
flatten = List.Flatten(list=members_3@L2, amount=code_block_4)
getLocation = Element.GetLocation(element=members_3)
Z = Point.Z(point=getLocation@L2)
flatten_2 = List.Flatten(list=Z@L2, amount=code_block_4)
maximumItem = List.MaximumItem(list=Z@L2)
code_block_5 = CodeBlock { 1; }
chop = List.Chop(list=maximumItem, lengths=code_block_5)
eq_3 = flatten_2@L2 == chop@L1
filterByBoolMask_3 = List.FilterByBoolMask(list=flatten, mask=eq_3)

# group: X ,Y Sortation
list_create_2 = List.Create()  # unwired: item0, item1
getLocation_2 = Element.GetLocation(element=filterByBoolMask_3.in)
X = Point.X(point=getLocation_2)
firstItem = List.FirstItem(list=X@L2)
code_block_6 = CodeBlock { 1; }
chop_2 = List.Chop(list=firstItem, lengths=code_block_6)
eq_4 = X@L2 == chop_2@L1
anyFalse = List.AnyFalse(list=eq_4@L2)
chop_3 = List.Chop(list=anyFalse, lengths=code_block_6)
Y = Point.Y(point=getLocation_2)
firstItem_2 = List.FirstItem(list=Y@L2)
chop_4 = List.Chop(list=firstItem_2, lengths=code_block_6)
eq_5 = Y@L2 == chop_4@L1
anyFalse_2 = List.AnyFalse(list=eq_5@L2)
chop_5 = List.Chop(list=anyFalse_2, lengths=code_block_6)
combine = List.Combine(combineFunction=list_create_2, list0=chop_3, list1=chop_5)
firstItem_3 = List.FirstItem(list=combine@L3)
if_ = RefactoredIf(test=firstItem_3@L1, true=X@L2, false=Y@L2)
sortIndexByValue = List.SortIndexByValue(list=if_)

# group: Compare
sortByKey = List.SortByKey(list=filterByBoolMask_3.in@L2, keys=sortIndexByValue@L2)
code_block_7 = CodeBlock { 2; }
takeItems = List.TakeItems(list=sortByKey.sortedList@L2, amount=code_block_7)
getLocation_3 = Element.GetLocation(element=takeItems@L2)
byBestFitThroughPoints = Line.ByBestFitThroughPoints(bestFitPoints=getLocation_3@L2)
code_block_8 = CodeBlock { "Width"; }
ʳʰʸᵗʰᵐ_elements = Rhythm.Revit.Elements.Elements.GetParameterValueByNameTypeOrInstance(element=takeItems, parameterName=code_block_8)
code_block_9 = CodeBlock { 2; }
list_clean = Custom[List Clean](list=byBestFitThroughPoints)  # package Genius Loci; Removes all Null, Empty and Blank from a list or nested list of lists.

# group: filtration
length = Curve.Length(curve=byBestFitThroughPoints)
div = ʳʰʸᵗʰᵐ_elements / code_block_9
sum = Math.Sum(values=div)
le = length <= sum

# group: Get
flatten_3 = List.Flatten(list=le)
filterByBoolMask_4 = List.FilterByBoolMask(list=filterByBoolMask_2.out, mask=flatten_3)
members_4 = Custom[Assembly.Members](assembly=filterByBoolMask_4.in)
members_5 = Custom[Assembly.Members](assembly=filterByBoolMask_4.out)

# group: Single Windows
categories = Categories("OST_Windows")
all_family_types_of_category = Custom[All Family Types Of Category](category=categories)  # package Clockwork for Dynamo 2.x; Gets all family types/symbols of a given category in the model.
byFamilyType = FamilyInstance.ByFamilyType(familyType=all_family_types_of_category)
flatten_4 = List.Flatten(list=byFamilyType)
id = Element.Id(element=members_2)
id_2 = Element.Id(element=members_4)
list_create_3 = List.Create(item0=id, item1=id_2)
flatten_5 = List.Flatten(list=list_create_3)
count = List.Count(list=flatten_5)

# group: Interior Window
element_host = Custom[Element Host](element=flatten_4)  # package Genius Loci; Gets the host of the element. Unlike the OOTB node FamilyInstance.GetHost, it also works for elements hosted by a linked document, wall sweeps, foundations, railings and builing pads. Based on a Clockwork's node
code_block_10 = CodeBlock { "Function"; }
ʳʰʸᵗʰᵐ_elements_2 = Rhythm.Revit.Elements.Elements.GetParameterValueByNameTypeOrInstance(element=element_host, parameterName=code_block_10)
code_block_11 = CodeBlock { 0; "INTERIOR WALL"; }
eq_6 = ʳʰʸᵗʰᵐ_elements_2 == code_block_11.out0
code_block_12 = CodeBlock { "Wall Type"; }
ʳʰʸᵗʰᵐ_elements_3 = Rhythm.Revit.Elements.Elements.GetParameterValueByNameTypeOrInstance(element=element_host, parameterName=code_block_12)
eq_7 = ʳʰʸᵗʰᵐ_elements_3 == code_block_11.out1
and_ = And(bool0=eq_6, bool1=eq_7)
filterByBoolMask_5 = List.FilterByBoolMask(list=flatten_4, mask=and_)

# group (continued): Single Windows
id_3 = Element.Id(element=filterByBoolMask_5.out)
eq_8 = id_3 == flatten_5  # lacing=CrossProduct
anyTrue_3 = List.AnyTrue(list=eq_8@L2)
filterByBoolMask_6 = List.FilterByBoolMask(list=filterByBoolMask_5.out, mask=anyTrue_3)
count_2 = List.Count(list=filterByBoolMask_6.in)

# group: Headeer Count
code_block_13 = CodeBlock { "Header Count"; }
code_block_14 = CodeBlock { 2; }
ʳʰʸᵗʰᵐ_elements_4 = Rhythm.Revit.Elements.Elements.SetParameterByNameTypeOrInstance(element=filterByBoolMask_6.out, parameterName=code_block_13, value=code_block_14)

# group: Match Type
code_block_15 = CodeBlock { "Width"; }
ʳʰʸᵗʰᵐ_elements_5 = Rhythm.Revit.Elements.Elements.GetParameterValueByNameTypeOrInstance(element=filterByBoolMask_6.out, parameterName=code_block_15)

# group: Dimentional 2X10 Filter
code_block_16 = CodeBlock(x=ʳʰʸᵗʰᵐ_elements_5) { x<=5.5; }
filterByBoolMask_7 = List.FilterByBoolMask(list=filterByBoolMask_6.out, mask=code_block_16)
filterByBoolMask_8 = List.FilterByBoolMask(list=ʳʰʸᵗʰᵐ_elements_5, mask=code_block_16)

# group: Heders Types
code_block_17 = CodeBlock { 6005790; 6005738; 6006151; 6005799; 6006154; 6006155; }
list_create_4 = List.Create(item0=code_block_17.out0, item1=code_block_17.out1, item2=code_block_17.out2, item3=code_block_17.out3, item4=code_block_17.out4, item5=code_block_17.out5)
element_by_id = ElementById(Id=list_create_4)
code_block_18 = CodeBlock { 0; 1; 2; 3; 4; 5; }
getItemAtIndex = List.GetItemAtIndex(list=element_by_id, index=code_block_18.out1)
getItemAtIndex_2 = List.GetItemAtIndex(list=element_by_id, index=code_block_18.out2)
getItemAtIndex_3 = List.GetItemAtIndex(list=element_by_id, index=code_block_18.out3)
getItemAtIndex_4 = List.GetItemAtIndex(list=element_by_id, index=code_block_18.out4)
getItemAtIndex_5 = List.GetItemAtIndex(list=element_by_id, index=code_block_18.out5)
getItemAtIndex_6 = List.GetItemAtIndex(list=element_by_id, index=code_block_18.out0)
name = Element.Name(element=element_by_id)

# group: Dimentional 2X10
code_block_19 = CodeBlock { "DIMENSIONAL : 2x10"; }
code_block_20 = CodeBlock { "Header Type"; }
ʳʰʸᵗʰᵐ_elements_6 = Rhythm.Revit.Elements.Elements.SetParameterByNameTypeOrInstance(element=filterByBoolMask_7.in, parameterName=code_block_20, value=getItemAtIndex)

# group: LVL: 9-1/4"
code_block_21 = CodeBlock(x=filterByBoolMask_8.out) { x<=9.5; }
filterByBoolMask_9 = List.FilterByBoolMask(list=filterByBoolMask_7.out, mask=code_block_21)
filterByBoolMask_10 = List.FilterByBoolMask(list=filterByBoolMask_8.out, mask=code_block_21)

# group: LVL: 9-1/4"
code_block_22 = CodeBlock { "LVL: 9-1/4"; }
code_block_23 = CodeBlock { "Header Type"; }
ʳʰʸᵗʰᵐ_elements_7 = Rhythm.Revit.Elements.Elements.SetParameterByNameTypeOrInstance(element=filterByBoolMask_9.in, parameterName=code_block_23, value=getItemAtIndex_2)

# group: LVL: 11-7/8" Filter
code_block_24 = CodeBlock(x=filterByBoolMask_10.out) { x<=15.5; }
filterByBoolMask_11 = List.FilterByBoolMask(list=filterByBoolMask_9.out, mask=code_block_24)
filterByBoolMask_12 = List.FilterByBoolMask(list=filterByBoolMask_10.out, mask=code_block_24)

code_block_25 = CodeBlock { "Header Type"; }

# group: LVL: 11-7/8"
code_block_26 = CodeBlock { "LVL: 11-7/8"; }
ʳʰʸᵗʰᵐ_elements_8 = Rhythm.Revit.Elements.Elements.SetParameterByNameTypeOrInstance(element=filterByBoolMask_11.in, parameterName=code_block_25, value=getItemAtIndex_3)

# group: LVL: 14" Filter
code_block_27 = CodeBlock(x=filterByBoolMask_12.out) { x<=17.5; }
filterByBoolMask_13 = List.FilterByBoolMask(list=filterByBoolMask_11.out, mask=code_block_27)
filterByBoolMask_14 = List.FilterByBoolMask(list=filterByBoolMask_12.out, mask=code_block_27)

# group: LVL: 14"
code_block_28 = CodeBlock { "Header Type"; }
ʳʰʸᵗʰᵐ_elements_9 = Rhythm.Revit.Elements.Elements.SetParameterByNameTypeOrInstance(element=filterByBoolMask_13.in, parameterName=code_block_28, value=getItemAtIndex_4)
code_block_29 = CodeBlock { "LVL: 14"; }

# group: LVL:16" Filter
code_block_30 = CodeBlock(x=filterByBoolMask_14.out) { x>17.6; }
filterByBoolMask_15 = List.FilterByBoolMask(list=filterByBoolMask_13.out, mask=code_block_30)
filterByBoolMask_16 = List.FilterByBoolMask(list=filterByBoolMask_12.out, mask=code_block_30)

code_block_31 = CodeBlock { "Header Type"; }

# group: LVL:16"
code_block_32 = CodeBlock { "LVL:16"; }
ʳʰʸᵗʰᵐ_elements_10 = Rhythm.Revit.Elements.Elements.SetParameterByNameTypeOrInstance(element=filterByBoolMask_15.in, parameterName=code_block_31, value=getItemAtIndex_5)

# group: Remove Mulions
string_from_object_3 = FromObject(object=members_2)
code_block_33 = CodeBlock { "Main"; }
eq_9 = string_from_object_3 == code_block_33
filterByBoolMask_17 = List.FilterByBoolMask(list=members_2, mask=eq_9)
string_from_object_4 = FromObject(object=filterByBoolMask_17.out)
code_block_34 = CodeBlock { "Secondary"; }
eq_10 = string_from_object_4 == code_block_34
filterByBoolMask_18 = List.FilterByBoolMask(list=filterByBoolMask_17.out, mask=eq_10)
list_create_5 = List.Create(item0=filterByBoolMask_18.out, item1=members_4)

# group: Window Row
code_block_35 = CodeBlock { 1; }
flatten_6 = List.Flatten(list=list_create_5, amount=code_block_35)
getLocation_4 = Element.GetLocation(element=list_create_5)
Z_2 = Point.Z(point=getLocation_4)
flatten_7 = List.Flatten(list=Z_2, amount=code_block_35)
maximumItem_2 = List.MaximumItem(list=Z_2@L2)
code_block_36 = CodeBlock { 1; }
chop_6 = List.Chop(list=maximumItem_2, lengths=code_block_36)
eq_11 = flatten_7@L2 == chop_6@L1
filterByBoolMask_19 = List.FilterByBoolMask(list=flatten_6, mask=eq_11)

# group: Get middle window
code_block_37 = CodeBlock { 2; }
flatten_8 = List.Flatten(list=filterByBoolMask_19.in@L2, amount=code_block_37)
code_block_38 = CodeBlock { 1; }
code_block_39 = CodeBlock { 2; }
code_block_40 = CodeBlock { 1; }

# group: X ,Y Sortation
list_create_6 = List.Create()  # unwired: item0, item1
getLocation_5 = Element.GetLocation(element=flatten_8)
X_2 = Point.X(point=getLocation_5)
firstItem_4 = List.FirstItem(list=X_2@L2)
code_block_41 = CodeBlock { 1; }
chop_7 = List.Chop(list=firstItem_4, lengths=code_block_41)
eq_12 = X_2@L2 == chop_7@L1
anyFalse_3 = List.AnyFalse(list=eq_12@L2)
chop_8 = List.Chop(list=anyFalse_3, lengths=code_block_41)
Y_2 = Point.Y(point=getLocation_5)
firstItem_5 = List.FirstItem(list=Y_2@L2)
chop_9 = List.Chop(list=firstItem_5, lengths=code_block_41)
eq_13 = Y_2@L2 == chop_9@L1
anyFalse_4 = List.AnyFalse(list=eq_13@L2)
chop_10 = List.Chop(list=anyFalse_4, lengths=code_block_41)
combine_2 = List.Combine(combineFunction=list_create_6, list0=chop_8, list1=chop_10)
firstItem_6 = List.FirstItem(list=combine_2@L3)
if_2 = RefactoredIf(test=firstItem_6@L1, true=X_2@L2, false=Y_2@L2)
sortIndexByValue_2 = List.SortIndexByValue(list=if_2)

# group (continued): Get middle window
sortByKey_2 = List.SortByKey(list=flatten_8@L2, keys=sortIndexByValue_2@L2)
count_3 = List.Count(list=sortByKey_2.sortedList@L2)
chop_11 = List.Chop(list=count_3, lengths=code_block_38)
div_2 = chop_11@L2 / code_block_39
ceiling = Math.Ceiling(number=div_2)
sub = ceiling - code_block_40
getItemAtIndex_7 = List.GetItemAtIndex(list=sortByKey_2.sortedList@L2, index=sub@L2)
flatten_9 = List.Flatten(list=getItemAtIndex_7)
flatten_10 = List.Flatten(list=sortByKey_2.sortedList)
id_4 = Element.Id(element=flatten_10)
id_5 = Element.Id(element=flatten_9)
eq_14 = id_4@L1 == id_5
anyTrue_4 = List.AnyTrue(list=eq_14@L2)
filterByBoolMask_20 = List.FilterByBoolMask(list=flatten_10, mask=anyTrue_4)
list_create_7 = List.Create(item0=filterByBoolMask_20.out, item1=filterByBoolMask_19.out)
flatten_11 = List.Flatten(list=list_create_7)

# group: Headeer Count
code_block_42 = CodeBlock { "Header Count"; }
code_block_43 = CodeBlock { 2; }
ʳʰʸᵗʰᵐ_elements_11 = Rhythm.Revit.Elements.Elements.SetParameterByNameTypeOrInstance(element=flatten_9, parameterName=code_block_42, value=code_block_43)

# group: Headeer Count
code_block_44 = CodeBlock { "Header Count"; }
code_block_45 = CodeBlock { 0; }
ʳʰʸᵗʰᵐ_elements_12 = Rhythm.Revit.Elements.Elements.SetParameterByNameTypeOrInstance(element=flatten_11, parameterName=code_block_44, value=code_block_45)

# group: None
code_block_46 = CodeBlock { "Header Type"; }
ʳʰʸᵗʰᵐ_elements_13 = Rhythm.Revit.Elements.Elements.SetParameterByNameTypeOrInstance(element=flatten_11, parameterName=code_block_46, value=getItemAtIndex_6)

# group: Single door
categories_2 = Categories("OST_Doors")
all_family_types_of_category_2 = Custom[All Family Types Of Category](category=categories_2)
byFamilyType_2 = FamilyInstance.ByFamilyType(familyType=all_family_types_of_category_2)
flatten_12 = List.Flatten(list=byFamilyType_2)
code_block_47 = CodeBlock { "Function"; }
ʳʰʸᵗʰᵐ_elements_14 = Rhythm.Revit.Elements.Elements.GetParameterValueByNameTypeOrInstance(element=flatten_12, parameterName=code_block_47)
code_block_48 = CodeBlock { 0; }
eq_15 = ʳʰʸᵗʰᵐ_elements_14 == code_block_48
filterByBoolMask_21 = List.FilterByBoolMask(list=flatten_12, mask=eq_15)

# group: Bearing wall detect
element_host_2 = Custom[Element Host](element=filterByBoolMask_21.in)
code_block_49 = CodeBlock { "Wall Type"; }
ʳʰʸᵗʰᵐ_elements_15 = Rhythm.Revit.Elements.Elements.GetParameterValueByNameTypeOrInstance(element=element_host_2, parameterName=code_block_49)
code_block_50 = CodeBlock { "BEARING WALL"; }
eq_16 = ʳʰʸᵗʰᵐ_elements_15 == code_block_50
filterByBoolMask_22 = List.FilterByBoolMask(list=filterByBoolMask_21.in, mask=eq_16)
list_create_8 = List.Create(item0=filterByBoolMask_5.in, item1=filterByBoolMask_22.out)
flatten_13 = List.Flatten(list=list_create_8)

# group: Match Type
code_block_51 = CodeBlock { "Width"; }
ʳʰʸᵗʰᵐ_elements_16 = Rhythm.Revit.Elements.Elements.GetParameterValueByNameTypeOrInstance(element=flatten_13, parameterName=code_block_51)

# group: Dimentional 2X10 Filter
code_block_52 = CodeBlock(x=ʳʰʸᵗʰᵐ_elements_16) { x<=5.5; }
filterByBoolMask_23 = List.FilterByBoolMask(list=flatten_13, mask=code_block_52)
filterByBoolMask_24 = List.FilterByBoolMask(list=ʳʰʸᵗʰᵐ_elements_16, mask=code_block_52)

# group: LVL: 9-1/4"
code_block_53 = CodeBlock(x=filterByBoolMask_24.out) { x<=9.5; }
filterByBoolMask_25 = List.FilterByBoolMask(list=filterByBoolMask_23.out, mask=code_block_53)
filterByBoolMask_26 = List.FilterByBoolMask(list=filterByBoolMask_24.out, mask=code_block_53)

# group: LVL: 11-7/8" Filter
code_block_54 = CodeBlock(x=filterByBoolMask_26.out) { x<=15.5; }
filterByBoolMask_27 = List.FilterByBoolMask(list=filterByBoolMask_25.out, mask=code_block_54)
filterByBoolMask_28 = List.FilterByBoolMask(list=filterByBoolMask_26.out, mask=code_block_54)

# group: LVL: 14" Filter
code_block_55 = CodeBlock(x=filterByBoolMask_28.out) { x<=17.5; }
filterByBoolMask_29 = List.FilterByBoolMask(list=filterByBoolMask_27.out, mask=code_block_55)
filterByBoolMask_30 = List.FilterByBoolMask(list=filterByBoolMask_28.out, mask=code_block_55)

# group: LVL:16" Filter
code_block_56 = CodeBlock(x=filterByBoolMask_30.out) { x>17.6; }
filterByBoolMask_31 = List.FilterByBoolMask(list=filterByBoolMask_29.out, mask=code_block_56)
filterByBoolMask_32 = List.FilterByBoolMask(list=filterByBoolMask_28.out, mask=code_block_56)

# group: Non Bearing Header _No paradigm Defult_Type
code_block_57 = CodeBlock { "Header Type"; }
ʳʰʸᵗʰᵐ_elements_17 = Rhythm.Revit.Elements.Elements.GetParameterValueByNameTypeOrInstance(element=filterByBoolMask_31.in, parameterName=code_block_57)

# group: Non Bearing Header _No paradigm Defult_Type
code_block_58 = CodeBlock { "Header Type"; }
ʳʰʸᵗʰᵐ_elements_18 = Rhythm.Revit.Elements.Elements.GetParameterValueByNameTypeOrInstance(element=filterByBoolMask_29.in, parameterName=code_block_58)

# group: Non Bearing Header _No paradigm Defult_Type
code_block_59 = CodeBlock { "Header Type"; }
ʳʰʸᵗʰᵐ_elements_19 = Rhythm.Revit.Elements.Elements.GetParameterValueByNameTypeOrInstance(element=filterByBoolMask_27.in, parameterName=code_block_59)

# group: Non Bearing Header _No paradigm Defult_Type
code_block_60 = CodeBlock { "Header Type"; }
ʳʰʸᵗʰᵐ_elements_20 = Rhythm.Revit.Elements.Elements.GetParameterValueByNameTypeOrInstance(element=filterByBoolMask_25.in, parameterName=code_block_60)

# group: Non Bearing Header _No paradigm Defult_Type
code_block_61 = CodeBlock { "Header Type"; }
ʳʰʸᵗʰᵐ_elements_21 = Rhythm.Revit.Elements.Elements.GetParameterValueByNameTypeOrInstance(element=filterByBoolMask_23.in, parameterName=code_block_61)

# group: Non Bearing Header _No paradigm Defult_Count
code_block_62 = CodeBlock { "Header Count"; }
ʳʰʸᵗʰᵐ_elements_22 = Rhythm.Revit.Elements.Elements.GetParameterValueByNameTypeOrInstance(element=flatten_13, parameterName=code_block_62)

# group: If Case
non_bearing_header = BoolSelector(false)  # graph input
use_paradigm_defult_for_interior = BoolSelector(false)  # "Use Paradigm Defult (for Interior Doors)"; graph input
and_2 = And(bool0=non_bearing_header, bool1=use_paradigm_defult_for_interior)
code_block_63 = CodeBlock { 2; }
or_ = Or(bool0=non_bearing_header, bool1=use_paradigm_defult_for_interior)
code_block_64 = CodeBlock { 0; }
if_3 = RefactoredIf(test=or_, true=ʳʰʸᵗʰᵐ_elements_22, false=code_block_64)
if_4 = RefactoredIf(test=and_2, true=code_block_63, false=if_3)

# group: If Case
and_3 = And(bool0=non_bearing_header, bool1=use_paradigm_defult_for_interior)
or_2 = Or(bool0=non_bearing_header, bool1=use_paradigm_defult_for_interior)
if_5 = RefactoredIf(test=or_2, true=ʳʰʸᵗʰᵐ_elements_17, false=getItemAtIndex_6)
if_6 = RefactoredIf(test=and_3, true=getItemAtIndex_5, false=if_5)

# group: LVL:16"
code_block_65 = CodeBlock { "Header Type"; }
ʳʰʸᵗʰᵐ_elements_23 = Rhythm.Revit.Elements.Elements.SetParameterByNameTypeOrInstance(element=filterByBoolMask_31.in, parameterName=code_block_65, value=if_6)

# group: If Case
and_4 = And(bool0=non_bearing_header, bool1=use_paradigm_defult_for_interior)
or_3 = Or(bool0=non_bearing_header, bool1=use_paradigm_defult_for_interior)
if_7 = RefactoredIf(test=or_3, true=ʳʰʸᵗʰᵐ_elements_18, false=getItemAtIndex_6)
if_8 = RefactoredIf(test=and_4, true=getItemAtIndex_4, false=if_7)

# group: LVL: 14"
code_block_66 = CodeBlock { "Header Type"; }
ʳʰʸᵗʰᵐ_elements_24 = Rhythm.Revit.Elements.Elements.SetParameterByNameTypeOrInstance(element=filterByBoolMask_29.in, parameterName=code_block_66, value=if_8)

# group: If Case
and_5 = And(bool0=non_bearing_header, bool1=use_paradigm_defult_for_interior)
or_4 = Or(bool0=non_bearing_header, bool1=use_paradigm_defult_for_interior)
if_9 = RefactoredIf(test=or_4, true=ʳʰʸᵗʰᵐ_elements_19, false=getItemAtIndex_6)
if_10 = RefactoredIf(test=and_5, true=getItemAtIndex_3, false=if_9)

# group: LVL: 11-7/8"
code_block_67 = CodeBlock { "Header Type"; }
ʳʰʸᵗʰᵐ_elements_25 = Rhythm.Revit.Elements.Elements.SetParameterByNameTypeOrInstance(element=filterByBoolMask_27.in, parameterName=code_block_67, value=if_10)

# group: If Case
and_6 = And(bool0=non_bearing_header, bool1=use_paradigm_defult_for_interior)
or_5 = Or(bool0=non_bearing_header, bool1=use_paradigm_defult_for_interior)
if_11 = RefactoredIf(test=or_5, true=ʳʰʸᵗʰᵐ_elements_20, false=getItemAtIndex_6)
if_12 = RefactoredIf(test=and_6, true=getItemAtIndex_2, false=if_11)

# group: LVL: 9-1/4"
code_block_68 = CodeBlock { "Header Type"; }
ʳʰʸᵗʰᵐ_elements_26 = Rhythm.Revit.Elements.Elements.SetParameterByNameTypeOrInstance(element=filterByBoolMask_25.in, parameterName=code_block_68, value=if_12)

# group: If Case
and_7 = And(bool0=non_bearing_header, bool1=use_paradigm_defult_for_interior)
or_6 = Or(bool0=non_bearing_header, bool1=use_paradigm_defult_for_interior)
if_13 = RefactoredIf(test=or_6, true=ʳʰʸᵗʰᵐ_elements_21, false=getItemAtIndex_6)
if_14 = RefactoredIf(test=and_7, true=getItemAtIndex, false=if_13)

# group: Dimentional 2X10
code_block_69 = CodeBlock { "Header Type"; }
ʳʰʸᵗʰᵐ_elements_27 = Rhythm.Revit.Elements.Elements.SetParameterByNameTypeOrInstance(element=filterByBoolMask_23.in, parameterName=code_block_69, value=if_14)

# group: Headeer Count
code_block_70 = CodeBlock { "Header Count"; }
ʳʰʸᵗʰᵐ_elements_28 = Rhythm.Revit.Elements.Elements.SetParameterByNameTypeOrInstance(element=flatten_13, parameterName=code_block_70, value=if_4)

# group: Garage Filter
flatten_14 = List.Flatten(list=filterByBoolMask_21.out)
code_block_71 = CodeBlock { "Family"; }
ʳʰʸᵗʰᵐ_elements_29 = Rhythm.Revit.Elements.Elements.GetParameterValueByNameTypeOrInstance(element=flatten_14, parameterName=code_block_71)
string_from_object_5 = FromObject(object=ʳʰʸᵗʰᵐ_elements_29)
code_block_72 = CodeBlock { "GarageDoor"; }
contains = String.Contains(string=string_from_object_5, searchFor=code_block_72)
filterByBoolMask_33 = List.FilterByBoolMask(list=flatten_14, mask=contains)
list_create_9 = List.Create(item0=filterByBoolMask_22.in, item1=filterByBoolMask_33.out)
flatten_15 = List.Flatten(list=list_create_9)

# group: Family Data
type = archilab.Revit.Elements.Elements.Type(element=flatten_14)
parameters = Element.Parameters(element=type)
watch = Watch(parameters)
parameters_2 = Element.Parameters(element=flatten_14)
watch_2 = Watch(parameters_2)

# group: Match Type
code_block_73 = CodeBlock { "Width"; }
ʳʰʸᵗʰᵐ_elements_30 = Rhythm.Revit.Elements.Elements.GetParameterValueByNameTypeOrInstance(element=flatten_15, parameterName=code_block_73)

# group: Dimentional 2X10 Filter
code_block_74 = CodeBlock(x=ʳʰʸᵗʰᵐ_elements_30) { x<=5.5; }
filterByBoolMask_34 = List.FilterByBoolMask(list=flatten_15, mask=code_block_74)
filterByBoolMask_35 = List.FilterByBoolMask(list=ʳʰʸᵗʰᵐ_elements_30, mask=code_block_74)

# group: LVL: 9-1/4"
code_block_75 = CodeBlock(x=filterByBoolMask_35.out) { x<=9.5; }
filterByBoolMask_36 = List.FilterByBoolMask(list=filterByBoolMask_34.out, mask=code_block_75)
filterByBoolMask_37 = List.FilterByBoolMask(list=filterByBoolMask_35.out, mask=code_block_75)

# group: LVL: 9-1/4"
code_block_76 = CodeBlock { "Header Type"; }
ʳʰʸᵗʰᵐ_elements_31 = Rhythm.Revit.Elements.Elements.SetParameterByNameTypeOrInstance(element=filterByBoolMask_36.in, parameterName=code_block_76, value=getItemAtIndex_2)

# group: LVL: 11-7/8" Filter
code_block_77 = CodeBlock(x=filterByBoolMask_37.out) { x<=15.5; }
filterByBoolMask_38 = List.FilterByBoolMask(list=filterByBoolMask_36.out, mask=code_block_77)
filterByBoolMask_39 = List.FilterByBoolMask(list=filterByBoolMask_37.out, mask=code_block_77)

# group: LVL: 11-7/8"
code_block_78 = CodeBlock { "Header Type"; }
ʳʰʸᵗʰᵐ_elements_32 = Rhythm.Revit.Elements.Elements.SetParameterByNameTypeOrInstance(element=filterByBoolMask_38.in, parameterName=code_block_78, value=getItemAtIndex_3)

# group: LVL: 14" Filter
code_block_79 = CodeBlock(x=filterByBoolMask_39.out) { x<=17.5; }
filterByBoolMask_40 = List.FilterByBoolMask(list=filterByBoolMask_38.out, mask=code_block_79)
filterByBoolMask_41 = List.FilterByBoolMask(list=filterByBoolMask_39.out, mask=code_block_79)

# group: LVL: 14"
code_block_80 = CodeBlock { "Header Type"; }
ʳʰʸᵗʰᵐ_elements_33 = Rhythm.Revit.Elements.Elements.SetParameterByNameTypeOrInstance(element=filterByBoolMask_40.in, parameterName=code_block_80, value=getItemAtIndex_4)

# group: LVL:16" Filter
code_block_81 = CodeBlock(x=filterByBoolMask_41.out) { x>17.6; }
filterByBoolMask_42 = List.FilterByBoolMask(list=filterByBoolMask_40.out, mask=code_block_81)
filterByBoolMask_43 = List.FilterByBoolMask(list=filterByBoolMask_39.out, mask=code_block_81)

# group: LVL:16"
code_block_82 = CodeBlock { "Header Type"; }
ʳʰʸᵗʰᵐ_elements_34 = Rhythm.Revit.Elements.Elements.SetParameterByNameTypeOrInstance(element=filterByBoolMask_42.in, parameterName=code_block_82, value=getItemAtIndex_5)

# group: Dimentional 2X10
code_block_83 = CodeBlock { "Header Type"; }
ʳʰʸᵗʰᵐ_elements_35 = Rhythm.Revit.Elements.Elements.SetParameterByNameTypeOrInstance(element=filterByBoolMask_34.in, parameterName=code_block_83, value=getItemAtIndex)

# group: Headeer Count
code_block_84 = CodeBlock { "Header Count"; }
code_block_85 = CodeBlock { 2; }
ʳʰʸᵗʰᵐ_elements_36 = Rhythm.Revit.Elements.Elements.SetParameterByNameTypeOrInstance(element=flatten_15, parameterName=code_block_84, value=code_block_85)

# group: Headeer Count
code_block_86 = CodeBlock { "Header Count"; }
code_block_87 = CodeBlock { 2; }
ʳʰʸᵗʰᵐ_elements_37 = Rhythm.Revit.Elements.Elements.SetParameterByNameTypeOrInstance(element=filterByBoolMask_33.in, parameterName=code_block_86, value=code_block_87)

# group: Match Type
code_block_88 = CodeBlock { "Width"; }
ʳʰʸᵗʰᵐ_elements_38 = Rhythm.Revit.Elements.Elements.GetParameterValueByNameTypeOrInstance(element=filterByBoolMask_33.in, parameterName=code_block_88)

# group: LVL: 11-7/8" Filter
code_block_89 = CodeBlock(x=ʳʰʸᵗʰᵐ_elements_38) { x<=16; }
filterByBoolMask_44 = List.FilterByBoolMask(list=ʳʰʸᵗʰᵐ_elements_38, mask=code_block_89)
filterByBoolMask_45 = List.FilterByBoolMask(list=filterByBoolMask_33.in, mask=code_block_89)

# group: LVL: 14" Filter
code_block_90 = CodeBlock(x=filterByBoolMask_44.out) { x<=18; }
filterByBoolMask_46 = List.FilterByBoolMask(list=filterByBoolMask_44.out, mask=code_block_90)
filterByBoolMask_47 = List.FilterByBoolMask(list=filterByBoolMask_45.out, mask=code_block_90)

# group: LVL:16" Filter
code_block_91 = CodeBlock(x=filterByBoolMask_46.out) { x>20; }
filterByBoolMask_48 = List.FilterByBoolMask(list=filterByBoolMask_44.out, mask=code_block_91)
filterByBoolMask_49 = List.FilterByBoolMask(list=filterByBoolMask_47.out, mask=code_block_91)

# group: LVL:16"
code_block_92 = CodeBlock { "Header Type"; }
ʳʰʸᵗʰᵐ_elements_39 = Rhythm.Revit.Elements.Elements.SetParameterByNameTypeOrInstance(element=filterByBoolMask_49.in, parameterName=code_block_92, value=getItemAtIndex_5)

# group: LVL: 14"
code_block_93 = CodeBlock { "Header Type"; }
ʳʰʸᵗʰᵐ_elements_40 = Rhythm.Revit.Elements.Elements.SetParameterByNameTypeOrInstance(element=filterByBoolMask_47.in, parameterName=code_block_93, value=getItemAtIndex_4)

# group: LVL: 11-7/8"
code_block_94 = CodeBlock { "Header Type"; }
ʳʰʸᵗʰᵐ_elements_41 = Rhythm.Revit.Elements.Elements.SetParameterByNameTypeOrInstance(element=filterByBoolMask_45.in, parameterName=code_block_94, value=getItemAtIndex_3)

# group: Get second window
getLocation_6 = Element.GetLocation(element=filterByBoolMask_3.out)
Z_3 = Point.Z(point=getLocation_6)
maximumItem_3 = List.MaximumItem(list=Z_3)
eq_17 = Z_3 == maximumItem_3
filterByBoolMask_50 = List.FilterByBoolMask(list=filterByBoolMask_3.out, mask=eq_17)
flatten_16 = List.Flatten(list=filterByBoolMask_50.in)
firstItem_7 = List.FirstItem(list=flatten_16)
getLocation_7 = Element.GetLocation(element=firstItem_7)
Z_4 = Point.Z(point=getLocation_7)

# group: First window
firstItem_8 = List.FirstItem(list=filterByBoolMask_3.in)
getLocation_8 = Element.GetLocation(element=firstItem_8)
X_3 = Point.X(point=getLocation_8)
Y_3 = Point.Y(point=getLocation_8)
byCoordinates = Point.ByCoordinates(x=X_3, y=Y_3, z=Z_4)
byStartPointEndPoint = Line.ByStartPointEndPoint(startPoint=getLocation_8, endPoint=byCoordinates)
length_2 = Curve.Length(curve=byStartPointEndPoint)

# group: Hight
code_block_95 = CodeBlock { "Height"; }
ʳʰʸᵗʰᵐ_elements_42 = Rhythm.Revit.Elements.Elements.GetParameterValueByNameTypeOrInstance(element=firstItem_7, parameterName=code_block_95)
eq_18 = length_2 == ʳʰʸᵗʰᵐ_elements_42

if_15 = RefactoredIf(test=eq_18)  # unwired: true, false

# group: Window Base Line
getLocation_9 = Element.GetLocation(element=filterByBoolMask_19.in)
list_create_10 = List.Create()  # unwired: item0, item1, item2, item3
code_block_96 = CodeBlock { "Width"; }
ʳʰʸᵗʰᵐ_elements_43 = Rhythm.Revit.Elements.Elements.GetParameterValueByNameTypeOrInstance(element=filterByBoolMask_19.in, parameterName=code_block_96)
code_block_97 = CodeBlock { 2; }
div_3 = ʳʰʸᵗʰᵐ_elements_43 / code_block_97
code_block_98 = CodeBlock { 2; }
code_block_99 = CodeBlock { 2; }
code_block_100 = CodeBlock { 1; }

# group: Get Vector
X_4 = Point.X(point=getLocation_9)
Y_4 = Point.Y(point=getLocation_9)
Z_5 = Point.Z(point=getLocation_9)
byCoordinates_2 = Vector.ByCoordinates(x=X_4, y=Y_4, z=Z_5)
element_host_3 = Custom[Element Host](element=filterByBoolMask_19.in@L2)
ʳʰʸᵗʰᵐ_hostobject = Rhythm.Revit.Elements.HostObject.ExteriorSurface(hostObject=element_host_3)
principalDirectionsAtParameter = Surface.PrincipalDirectionsAtParameter(surface=ʳʰʸᵗʰᵐ_hostobject)
lastItem = List.LastItem(list=principalDirectionsAtParameter)
tangentAtVParameter = Surface.TangentAtVParameter(surface=ʳʰʸᵗʰᵐ_hostobject)

# group (continued): Window Base Line
reverse = Vector.Reverse(vector=tangentAtVParameter)
byStartPointDirectionLength = Line.ByStartPointDirectionLength(startPoint=getLocation_9, direction=reverse, length=div_3)
flatten_17 = List.Flatten(list=byStartPointDirectionLength@L4, amount=code_block_98)
startPoint = Curve.StartPoint(curve=flatten_17)
endPoint = Curve.EndPoint(curve=flatten_17)
byStartPointDirectionLength_2 = Line.ByStartPointDirectionLength(startPoint=getLocation_9, direction=tangentAtVParameter, length=div_3)
flatten_18 = List.Flatten(list=byStartPointDirectionLength_2@L4, amount=code_block_99)
endPoint_2 = Curve.EndPoint(curve=flatten_18)
startPoint_2 = Curve.StartPoint(curve=flatten_18)
combine_3 = List.Combine(combineFunction=list_create_10, list0=startPoint, list1=endPoint, list2=endPoint_2, list3=startPoint_2)
flatten_19 = List.Flatten(list=combine_3@L3, amount=code_block_100)
byBestFitThroughPoints_2 = Line.ByBestFitThroughPoints(bestFitPoints=flatten_19)

# group: Width
length_3 = Curve.Length(curve=byBestFitThroughPoints_2)
code_block_101 = CodeBlock { "Width"; }

# group: Dimentional 2X10 Filter
code_block_102 = CodeBlock(x=length_3) { x<=5.5; }
filterByBoolMask_51 = List.FilterByBoolMask(list=length_3, mask=code_block_102)
filterByBoolMask_52 = List.FilterByBoolMask(list=flatten_9, mask=code_block_102)

# group: LVL: 9-1/4"
code_block_103 = CodeBlock(x=filterByBoolMask_51.out) { x<=9.5; }
filterByBoolMask_53 = List.FilterByBoolMask(list=filterByBoolMask_51.out, mask=code_block_103)
filterByBoolMask_54 = List.FilterByBoolMask(list=filterByBoolMask_52.out, mask=code_block_103)

# group: LVL: 11-7/8" Filter
code_block_104 = CodeBlock(x=filterByBoolMask_53.out) { x<=15.5; }
filterByBoolMask_55 = List.FilterByBoolMask(list=filterByBoolMask_53.out, mask=code_block_104)
filterByBoolMask_56 = List.FilterByBoolMask(list=filterByBoolMask_54.out, mask=code_block_104)

# group: LVL: 14" Filter
code_block_105 = CodeBlock(x=filterByBoolMask_55.out) { x<=17.5; }
filterByBoolMask_57 = List.FilterByBoolMask(list=filterByBoolMask_55.out, mask=code_block_105)
filterByBoolMask_58 = List.FilterByBoolMask(list=filterByBoolMask_56.out, mask=code_block_105)

# group: LVL:16" Filter
code_block_106 = CodeBlock(x=filterByBoolMask_57.out) { x>17.6; }
filterByBoolMask_59 = List.FilterByBoolMask(list=filterByBoolMask_55.out, mask=code_block_106)
filterByBoolMask_60 = List.FilterByBoolMask(list=filterByBoolMask_58.out, mask=code_block_106)

# group: LVL:16"
code_block_107 = CodeBlock { "Header Type"; }
ʳʰʸᵗʰᵐ_elements_44 = Rhythm.Revit.Elements.Elements.SetParameterByNameTypeOrInstance(element=filterByBoolMask_60.in, parameterName=code_block_107, value=getItemAtIndex_5)

# group: LVL: 14"
code_block_108 = CodeBlock { "Header Type"; }
ʳʰʸᵗʰᵐ_elements_45 = Rhythm.Revit.Elements.Elements.SetParameterByNameTypeOrInstance(element=filterByBoolMask_58.in, parameterName=code_block_108, value=getItemAtIndex_4)

# group: LVL: 11-7/8"
code_block_109 = CodeBlock { "Header Type"; }
ʳʰʸᵗʰᵐ_elements_46 = Rhythm.Revit.Elements.Elements.SetParameterByNameTypeOrInstance(element=filterByBoolMask_56.in, parameterName=code_block_109, value=getItemAtIndex_3)

# group: LVL: 9-1/4"
code_block_110 = CodeBlock { "Header Type"; }
ʳʰʸᵗʰᵐ_elements_47 = Rhythm.Revit.Elements.Elements.SetParameterByNameTypeOrInstance(element=filterByBoolMask_54.in, parameterName=code_block_110, value=getItemAtIndex_2)

# group: Dimentional 2X10
code_block_111 = CodeBlock { "Header Type"; }
ʳʰʸᵗʰᵐ_elements_48 = Rhythm.Revit.Elements.Elements.SetParameterByNameTypeOrInstance(element=filterByBoolMask_52.in, parameterName=code_block_111, value=getItemAtIndex)
